# Grasshopper definition catenary experimentation.gh (Grasshopper 1.0.8)
# plug-ins: Kangaroo2 Components

yz_plane = YZPlane(Origin=Point(0, 0, 0))
number_slider = Slider(28, range=0..1000)
unit_y = UnitY(Factor=Slider(269, range=0..500))
construct_point = ConstructPoint(XCoordinate=0, YCoordinate=0, ZCoordinate=0)
subtraction = Subtraction(A=number_slider, B="1")
arc = Arc(Plane=yz_plane, Radius=Slider(5709, range=0..30000), Angle=Domain(0, 3.141592654))  # -> Arc, Length
range = Range(Domain=Domain(0, 1), Steps=subtraction)
linear_array = LinearArray(Geometry=construct_point, Direction=unit_y, Count=number_slider)  # -> Geometry, Transform
unit_x = UnitX(Factor=Slider(2000, range=0..2000))
divide_curve = DivideCurve(Curve=arc.Arc, Count=Slider(29, range=0..100), Kinks=False)  # -> Points, Tangents, Parameters
graph_mapper = GraphMapper(
    range,
    x0=0,
    x1=1,
    y0=0,
    y1=1,
    Ox=0.5525892973,
    Oy=0.5265547037,
    Px=0.5137028098,
    Py=0.9854108095,
    container_name="Parabola")
move = Move(Geometry=linear_array.Geometry, Motion=unit_x)  # -> Geometry, Transform
unit_x_2 = UnitX(Factor=Slider(20000, range=0..100000))
point = Point(divide_curve.Points)
multiplication = Multiplication(A=Slider(157, range=0..2000), B=graph_mapper)
move_2 = Move(Geometry=divide_curve.Points, Motion=unit_x_2)  # -> Geometry, Transform
unit_z = UnitZ(Factor=1)
point_2 = Point(move_2.Geometry)
catenary = Catenary(PointA=linear_array.Geometry, PointB=move.Geometry, Length=multiplication, Gravity=unit_z)
W = WidthCount(20)
mplane = MeshPlane(Boundary={Plane=PlaneXY(10000, 0, 0), Size=Domain2(u=-10000..10000, v=-20000..20000)}, WidthCount=W, HeightCount=W)  # -> Mesh, Area

anchorxyz = AnchorXYZ(X="False", Y="True", Z="False", Strength=1000)

mc = MeshCorners(Mesh=mplane.Mesh, Angle=2.35619449)
edgelengths = EdgeLengths(Mesh=mplane.Mesh, LengthFactor=Slider(0.76, range=0..1), Strength=10)
vertexloads = VertexLoads(Mesh=mplane.Mesh, Strength=300)
anchor = Anchor(Point=mc, Strength=1000)
grab = Grab(On=True, Strength=1, Range=3)  # -> Grab, Anchors
reset = Button()
solver = Solver(
    GoalObjects=[anchor, grab.Grab, anchorxyz, edgelengths, vertexloads],
    Reset=reset,
    Threshold=1e-15,
    Tolerance=0.01,
    On=True)  # -> I, V, O
data = Data(solver.O)
