# Grasshopper definition experiment.gh (Grasshopper 1.0.8)

rectangle = Rectangle({Plane=PlaneXY(100, 100, 0), Size=Domain2(u=-100..100, v=-100..100)})
mesh_plane = MeshPlane(Boundary=rectangle, WidthCount=10, HeightCount=10)  # -> Mesh, Area
rectangle_2 = Rectangle({Plane=PlaneXY(100, -100, 0), Size=Domain2(u=-100..100, v=-100..100)})
unit_x = UnitX(Factor=1)
populate_2d = Populate2D(Region=rectangle, Count=Slider(346, range=0..1000), Seed=Slider(10, range=0..10))
mesh_plane_2 = MeshPlane(Boundary=rectangle_2, WidthCount=10, HeightCount=10)  # -> Mesh, Area
deconstruct_mesh = DeconstructMesh(Mesh=mesh_plane.Mesh)  # -> Vertices, Faces, Colours, Normals
populate_2d_2 = Populate2D(Region=rectangle_2, Count=Slider(346, range=0..1000), Seed=Slider(10, range=0..10))
rotate = Rotate(Geometry=rectangle_2, Angle=Slider(90, range=0..100), Plane=unit_x)  # -> Geometry, Transform
distance = Distance(PointA=populate_2d, PointB=graft(deconstruct_mesh.Vertices))
deconstruct_mesh_2 = DeconstructMesh(Mesh=mesh_plane_2.Mesh)  # -> Vertices, Faces, Colours, Normals
distance_2 = Distance(PointA=populate_2d_2, PointB=graft(deconstruct_mesh_2.Vertices))
graph_mapper = GraphMapper(
    distance,
    x0=0,
    x1=10,
    y0=0,
    y1=10,
    container_name="Sinc",
    Equation_X0=0.07343988866,
    Equation_X1=0.8761985898,
    Equation_Y0=0.8605352044,
    Equation_Y1=0.3219099045)
graph_mapper_2 = GraphMapper(
    distance_2,
    x0=0,
    x1=10,
    y0=0,
    y1=10,
    container_name="Sinc",
    Equation_X0=0.07343988866,
    Equation_X1=0.8761985898,
    Equation_Y0=0.8605352044,
    Equation_Y1=0.3219099045)
mass_addition = MassAddition(Input=graph_mapper)  # -> flatten(Result), PartialResults
mass_addition_2 = MassAddition(Input=graph_mapper_2)  # -> flatten(Result), PartialResults
unit_z = UnitZ(Factor=mass_addition.Result)
unit_z_2 = UnitZ(Factor=mass_addition_2.Result)
move = Move(Geometry=deconstruct_mesh.Vertices, Motion=unit_z)  # -> Geometry, Transform
move_2 = Move(Geometry=deconstruct_mesh_2.Vertices, Motion=unit_z_2)  # -> Geometry, Transform
construct_mesh = ConstructMesh(Vertices=move.Geometry, Faces=deconstruct_mesh.Faces)
construct_mesh_2 = ConstructMesh(Vertices=move_2.Geometry, Faces=deconstruct_mesh_2.Faces)
custom_preview = CustomPreview(
    Geometry=construct_mesh,
    Material={diffuse=RGB(228, 178, 227), emission=RGB(68, 53, 68), shine=0.5, specular=RGB(255, 254, 255), transparency=0})
custom_preview_2 = CustomPreview(
    Geometry=construct_mesh_2,
    Material={diffuse=RGB(228, 178, 227), emission=RGB(68, 53, 68), shine=0.5, specular=RGB(255, 254, 255), transparency=0})
