# Grasshopper definition final stair.gh (Grasshopper 1.0.8)

# ---- group: Stair Treads
no_of_treads = Slider(26, range=0..100)
construct_point = ConstructPoint(XCoordinate=0, YCoordinate=0, ZCoordinate=0)
inside_diameter = Slider(2400, range=0..2500)
panel = Panel("5")
division = Division(A=no_of_treads, B=panel)
point = Point(construct_point)
treads_for_landing = Slider(4, range=0..10)
division_2 = Division(A=inside_diameter, B=2)
stair_width = Slider(1200, range=0..1200)
tread_height = Slider(200, range=0..1000)
circle = Circle(Plane=point, Radius=division_2)
division_3 = Division(A="360", B=no_of_treads)
division_4 = Division(A="360", B=division)
offset_curve = OffsetCurve(Curve=circle, Distance=stair_width, Corners=1)
addition = Addition(A=no_of_treads, B=1)
subtraction = Subtraction(A=treads_for_landing, B=1)
end_points = EndPoints(Curve=circle)  # -> Start, End
series = Series(Start=0, Step=division_3, Count=addition)
boundary_surfaces = BoundarySurfaces(Edges=flatten([circle, offset_curve]))
end_points_2 = EndPoints(Curve=offset_curve)  # -> Start, End
subtraction_2 = Subtraction(A=no_of_treads, B=subtraction)
line = Line(StartPoint=end_points.Start, EndPoint=end_points_2.Start)
end_points_3 = EndPoints(Curve=line)  # -> Start, End
series_2 = Series(Start=0, Step=division_3, Count=addition)
addition_2 = Addition(A=subtraction_2, B=1)
rotate = Rotate(Geometry=end_points_2.Start, Angle=degrees(series), Plane=point)  # -> Geometry, Transform
point_2 = Point(end_points_3.Start)
rotate_2 = Rotate(Geometry=point_2, Angle=degrees(series_2), Plane=PlaneXY(0, 0, 0))  # -> Geometry, Transform
series_3 = Series(Start=0, Step=tread_height, Count=addition_2)
unit_z = UnitZ(Factor=series_3)
move = Move(Geometry=rotate_2.Geometry, Motion=unit_z)  # -> Geometry, Transform
unit_z_2 = UnitZ(Factor=tread_height)
unit_z_3 = UnitZ(Factor=tread_height)
move_2 = Move(Geometry=line, Motion=unit_z_2)  # -> Geometry, Transform
move_3 = Move(Geometry=rotate.Geometry, Motion=unit_z)  # -> Geometry, Transform
unit_z_4 = UnitZ(Factor=Slider(378, range=0..1000))
end_points_4 = EndPoints(Curve=move_2.Geometry)  # -> Start, End
number_slider = Slider(900, range=0..900)
move_4 = Move(Geometry=end_points_4.End, Motion=unit_z_4)  # -> Geometry, Transform
move_5 = Move(Geometry=end_points_4.Start, Motion=unit_z_4)  # -> Geometry, Transform
unit_z_5 = UnitZ(Factor=number_slider)
move_6 = Move(Geometry=move.Geometry, Motion=unit_z_5)  # -> Geometry, Transform
list_item = ListItem(List=move_6.Geometry, Index=0, Wrap=True)
move_7 = Move(Geometry=list_item, Motion=unit_z_3)  # -> Geometry, Transform
unit_z_6 = UnitZ(Factor=number_slider)
move_8 = Move(Geometry=move_3.Geometry, Motion=unit_z_5)  # -> Geometry, Transform
number_slider_2 = Slider(2, range=0..10)
list_item_2 = ListItem(List=move_8.Geometry, Index=0, Wrap=True)
move_9 = Move(Geometry=list_item_2, Motion=unit_z_3)  # -> Geometry, Transform
nurbs_curve = NurbsCurve(
    Vertices=[list_item_2, move_4.Geometry, end_points_4.End, end_points_4.Start, move_5.Geometry, list_item],
    Degree=number_slider_2,
    Periodic=False)  # -> Curve, Length, Domain
nurbs_curve_2 = NurbsCurve(
    Vertices=[move_9.Geometry, move_4.Geometry, end_points_4.End, end_points_4.Start, move_5.Geometry, move_7.Geometry],
    Degree=number_slider_2,
    Periodic=False)  # -> Curve, Length, Domain
series_4 = Series(Start=0, Step=tread_height, Count=subtraction_2)
subtraction_3 = Subtraction(A=division_3, B=Slider(1.617, range=0..10))
unit_z_7 = UnitZ(Factor=series_4)
rotate_3 = Rotate(Geometry=nurbs_curve_2.Curve, Angle=degrees(subtraction_3), Plane=PlaneXY(0, 0, 0))  # -> Geometry, Transform
rotate_4 = Rotate(Geometry=nurbs_curve.Curve, Angle=degrees(series), Plane=PlaneXY(0, 0, 0))  # -> Geometry, Transform
rotate_5 = Rotate(Geometry=rotate_3.Geometry, Angle=degrees(series), Plane=PlaneXY(0, 0, 0))  # -> Geometry, Transform
move_10 = Move(Geometry=rotate_4.Geometry, Motion=unit_z_7)  # -> Geometry, Transform
panel_2 = Panel("""50
51
52
53
53""")
move_11 = Move(Geometry=rotate_5.Geometry, Motion=unit_z_7)  # -> Geometry, Transform
cull_index = CullIndex(List=move_10.Geometry, Indices=panel_2, Wrap=True)
weave = Weave(Pattern=[0, 1], Stream0=cull_index, Stream1=move_11.Geometry, NullGaps=False)
end_points_5 = EndPoints(Curve=weave)  # -> Start, End
geometry = Geometry(end_points_5.End)
panel_3 = Panel(cull_index)

# ---- group: Stair Structure
subtraction_4 = Subtraction(A=no_of_treads, B=treads_for_landing)
addition_3 = Addition(A=subtraction_4, B="1")
multiplication = Multiplication(A=tread_height, B=addition_3)
series_5 = Series(Start=0, Step=division_4, Count=division)
multiplication_2 = Multiplication(A=tread_height, B=panel)
series_6 = Series(Start=0, Step=multiplication_2, Count=division)
unit_z_8 = UnitZ(Factor=series_6)

# ---- group: Stair external
number_slider_3 = Slider(200, range=0..1000)
interpolate = Interpolate(Vertices=move_6.Geometry, Degree=3, Periodic=False, KnotStyle=1)  # -> Curve, Length, Domain
negative = Negative(Value=number_slider_3)
unit_x = UnitX(Factor=1)
interpolate_2 = Interpolate(Vertices=move_8.Geometry, Degree=3, Periodic=False, KnotStyle=1)  # -> Curve, Length, Domain
division_5 = Division(A=number_slider_3, B="2")
end_points_6 = EndPoints(Curve=interpolate.Curve)  # -> Start, End
offset_curve_2 = OffsetCurve(Curve=interpolate.Curve, Distance=negative, Plane=unit_x, Corners=1)
negative_2 = Negative(Value=Slider(900, range=0..900))
unit_z_9 = UnitZ(Factor=division_5)
offset_curve_3 = OffsetCurve(Curve=interpolate_2.Curve, Distance=number_slider_3, Plane=unit_x, Corners=1)
end_points_7 = EndPoints(Curve=interpolate_2.Curve)  # -> Start, End
unit_z_10 = UnitZ(Factor=negative_2)
end_points_8 = EndPoints(Curve=offset_curve_2)  # -> Start, End
addition_4 = Addition(A=end_points_8.Start, B=end_points_6.Start)
division_6 = Division(A=addition_4, B="2")
end_points_9 = EndPoints(Curve=offset_curve_3)  # -> Start, End
move_12 = Move(Geometry=offset_curve_2, Motion=unit_z_10)  # -> Geometry, Transform
addition_5 = Addition(A=end_points_7.Start, B=end_points_9.Start)
move_13 = Move(Geometry=offset_curve_3, Motion=unit_z_10)  # -> Geometry, Transform
move_14 = Move(Geometry=division_6, Motion=unit_z_9)  # -> Geometry, Transform
division_7 = Division(A=addition_5, B="2")
division_8 = Division(A=number_slider_3, B="2")
extrude = Extrude(Base=offset_curve_2, Direction=unit_z_10)
extrude_2 = Extrude(Base=offset_curve_3, Direction=unit_z_10)
end_points_10 = EndPoints(Curve=move_13.Geometry)  # -> Start, End
end_points_11 = EndPoints(Curve=move_12.Geometry)  # -> Start, End
unit_z_11 = UnitZ(Factor=division_8)
addition_6 = Addition(A=end_points_10.Start, B=end_points_11.Start)
arc_3pt = Arc3Pt(PointA=end_points_8.Start, PointB=move_14.Geometry, PointC=end_points_6.Start)  # -> Arc, Plane, Radius
addition_7 = Addition(A=end_points_10.End, B=end_points_11.End)
move_15 = Move(Geometry=division_7, Motion=unit_z_11)  # -> Geometry, Transform
division_9 = Division(A=addition_7, B="2")
division_10 = Division(A=addition_6, B="2")
sweep2 = Sweep2(Rail1=interpolate.Curve, Rail2=offset_curve_2, Sections=arc_3pt.Arc, SameHeight=False)
line_2 = Line(StartPoint=end_points_8.Start, EndPoint=end_points_11.Start)
number_slider_4 = Slider(10000, range=0..10000)
arc_3pt_2 = Arc3Pt(PointA=end_points_7.Start, PointB=move_15.Geometry, PointC=end_points_9.Start)  # -> Arc, Plane, Radius
line_3 = Line(StartPoint=end_points_9.Start, EndPoint=end_points_10.Start)
negative_3 = Negative(Value=Slider(300, range=0..300))
line_4 = Line(StartPoint=end_points_10.Start, EndPoint=end_points_11.Start)
sweep2_2 = Sweep2(Rail1=offset_curve_3, Rail2=offset_curve_2, Sections=arc_3pt_2.Arc, SameHeight=False)
cylinder = Cylinder(Base=PlaneXY(0, 0, 0), Radius=number_slider_4, Length=negative_3)
cap_holes = CapHoles(Brep=cylinder)

# ---- group: Stair Structure (continued)
multiplication_3 = Multiplication(A=number_slider_3, B="2")
addition_8 = Addition(A=stair_width, B=multiplication_3)
division_11 = Division(A=addition_8, B="2")
negative_4 = Negative(Value=division_11)
unit_z_12 = UnitZ(Factor=negative_4)
move_16 = Move(Geometry=division_10, Motion=unit_z_12)  # -> Geometry, Transform
arc_3pt_3 = Arc3Pt(PointA=end_points_10.Start, PointB=move_16.Geometry, PointC=end_points_11.Start)  # -> Arc, Plane, Radius
rotate_6 = Rotate(Geometry=arc_3pt_3.Arc, Angle=degrees(series_5), Plane=PlaneXY(0, 0, 0))  # -> Geometry, Transform
move_17 = Move(Geometry=rotate_6.Geometry, Motion=unit_z_8)  # -> Geometry, Transform
end_points_12 = EndPoints(Curve=move_17.Geometry)  # -> Start, End
cull_index_2 = CullIndex(List=move_17.Geometry, Indices="0", Wrap=True)
curve_middle = CurveMiddle(Curve=move_17.Geometry)
move_18 = Move(Geometry=end_points_12.Start, Motion=unit_z_5)  # -> Geometry, Transform
move_19 = Move(Geometry=end_points_12.End, Motion=unit_z_5)  # -> Geometry, Transform
project_point = ProjectPoint(Point=curve_middle, Direction=Vector(0, 0, -1), Geometry=cap_holes)  # -> Point, Index
line_5 = Line(StartPoint=move_18.Geometry, EndPoint=end_points_12.Start)
line_6 = Line(StartPoint=move_19.Geometry, EndPoint=end_points_12.End)
line_7 = Line(StartPoint=curve_middle, EndPoint=project_point.Point)
cull_index_3 = CullIndex(List=line_6, Indices="0", Wrap=True)
cull_index_4 = CullIndex(List=line_5, Indices="0", Wrap=True)
pipe = Pipe(Curve=[line_7, cull_index_2, cull_index_3, cull_index_4], Radius=Slider(50, range=0..70), Caps=2)

# ---- group: Top Floor Plane
negative_5 = Negative(Value=number_slider_3)
xy_plane = XYPlane(Origin=Point(0, 0, 0))
offset_curve_4 = OffsetCurve(Curve=circle, Distance=negative_5, Corners=1)
divide_curve = DivideCurve(Curve=offset_curve_4, Count=10, Kinks=False)  # -> Points, Tangents, Parameters
offset_curve_5 = OffsetCurve(Curve=offset_curve, Distance=number_slider_3, Corners=1)
circle_2 = Circle(Plane=xy_plane, Radius=number_slider_4)
divide_curve_2 = DivideCurve(Curve=offset_curve_5, Count=10, Kinks=False)  # -> Points, Tangents, Parameters
list_item_3 = ListItem(List=divide_curve.Points, Index="0", Wrap=True)
loft = Loft(
    Curves=flatten([circle_2, offset_curve_5]),
    Options={Adjust=False, Closed=False, LoftEnds=0, LoftSimp=0, LoftType=0, Rebuild=10, Refit=0.01})
panel_4 = Panel("""2
3
4
5
6
7
8
9
10""")
list_item_4 = ListItem(List=divide_curve_2.Points, Index=panel_4, Wrap=True)
unit_z_13 = UnitZ(Factor=multiplication)
interpolate_3 = Interpolate(Vertices=flatten([list_item_3, list_item_4]), Degree=3, Periodic=False, KnotStyle=1)  # -> Curve, Length, Domain
end_points_13 = EndPoints(Curve=interpolate_3.Curve)  # -> Start, End
line_8 = Line(StartPoint=end_points_13.Start, EndPoint=end_points_13.End)
join_curves = JoinCurves(Curves=[line_8, interpolate_3.Curve], Preserve=False)
unit_z_14 = UnitZ(Factor=negative_3)
boundary_surfaces_2 = BoundarySurfaces(Edges=flatten([join_curves, circle_2]))
extrude_3 = Extrude(Base=boundary_surfaces_2, Direction=unit_z_14)
move_20 = Move(Geometry=extrude_3, Motion=unit_z_13)  # -> Geometry, Transform

# ---- group: Railing
number_slider_5 = Slider(896, range=0..10000)
addition_9 = Addition(A=multiplication, B=number_slider_5)
unit_z_15 = UnitZ(Factor=addition_9)
move_21 = Move(Geometry=interpolate_3.Curve, Motion=unit_z_15)  # -> Geometry, Transform
negative_6 = Negative(Value=number_slider_5)
offset_curve_6 = OffsetCurve(Curve=move_21.Geometry, Distance=Slider(100, range=0..100), Corners=1)
unit_z_16 = UnitZ(Factor=negative_6)
divide_curve_3 = DivideCurve(Curve=offset_curve_6, Count="8", Kinks=False)  # -> Points, Tangents, Parameters
extrude_4 = Extrude(Base=offset_curve_6, Direction=unit_z_16)
unit_x_2 = UnitX(Factor=Slider(10, range=0..10))
project_point_2 = ProjectPoint(Point=divide_curve_3.Points, Direction=Vector(0, 0, -1), Geometry=move_20.Geometry)  # -> Point, Index
extrude_5 = Extrude(Base=extrude_4, Direction=unit_x_2)
list_item_5 = ListItem(List=project_point_2.Point, Index="8", Wrap=True)
list_item_6 = ListItem(List=divide_curve_3.Points, Index="8", Wrap=True)
line_9 = Line(StartPoint=divide_curve_3.Points, EndPoint=project_point_2.Point)
line_10 = Line(StartPoint=list_item_6, EndPoint=list_item_5)
join_curves_2 = JoinCurves(Curves=[offset_curve_6, line_10], Preserve=False)
cull_index_5 = CullIndex(List=line_9, Indices="8", Wrap=True)
pipe_2 = Pipe(Curve=[cull_index_5, join_curves_2], Radius=Slider(30, range=0..100), Caps=2)

# ---- group: Stair external (continued)
move_22 = Move(Geometry=division_9, Motion=unit_z_12)  # -> Geometry, Transform
arc_3pt_4 = Arc3Pt(PointA=end_points_10.End, PointB=move_22.Geometry, PointC=end_points_11.End)  # -> Arc, Plane, Radius
sweep2_3 = Sweep2(Rail1=move_13.Geometry, Rail2=move_12.Geometry, Sections=[move_17.Geometry, arc_3pt_4.Arc], SameHeight=False)
split_brep = SplitBrep(Brep=sweep2_3, Cutter=cap_holes)
list_item_7 = ListItem(List=split_brep, Index="1", Wrap=True)

# ---- group: Stair Treads (continued)
pull_point = PullPoint(Point=geometry, Geometry=interpolate.Curve, ClosestOnly=True)  # -> ClosestPoint, Distance
negative_7 = Negative(Value=pull_point.Distance)
extend_curve = ExtendCurve(Curve=weave, Type=0, Start=negative_7, End=negative_7)
cull_index_6 = CullIndex(List=extend_curve, Indices="-1", Wrap=True)
loft_2 = Loft(Curves=cull_index_6, Options={Adjust=False, Closed=False, LoftEnds=0, LoftSimp=0, LoftType=2, Rebuild=10, Refit=0.01})

# ----
join_curves_3 = JoinCurves(Curves=flatten([nurbs_curve.Curve, arc_3pt_2.Arc, line_3, line_2, arc_3pt.Arc, line_4]), Preserve=False)
patch = Patch(Curves=join_curves_3, Spans=20, Flexibility=1, Trim=True)
brep_join = BrepJoin(Breps=flatten([patch, sweep2_2, loft_2, list_item_7, extrude_2, extrude, sweep2]))  # -> Breps, Closed
