# Grasshopper definition grasshopper stairs v2.gh (Grasshopper 1.0.8)

center_gap = Slider(1000, range=0..2000)
angle = Slider(10, range=0..100)
height = Slider(444, range=0..1000)
number = Slider(35, range=0..100)
pt = ConstructPoint(XCoordinate=0, YCoordinate=0, ZCoordinate=0)
division = Division(A="360", B=angle)
pt_2 = Point(pt)
X = UnitX(Factor=center_gap)
series = Series(Start=0, Step=height, Count=number)
move = Move(Geometry=pt_2, Motion=X)  # -> Geometry, Transform
series_2 = Series(Start=0, Step=division, Count=number)
railing = Slider(1100, range=0..10000)
Z = UnitZ(Factor=series)
road_width = Slider(1500, range=0..2000)
rotate = Rotate(Geometry=move.Geometry, Angle=degrees(series_2), Plane=PlaneXY(0, 0, 0))  # -> Geometry, Transform
X_2 = UnitX(Factor=1)
move_2 = Move(Geometry=rotate.Geometry, Motion=Z)  # -> Geometry, Transform
Z_2 = UnitZ(Factor=railing)
intcrv = Interpolate(Vertices=move_2.Geometry, Degree=3, Periodic=False, KnotStyle=1)  # -> Curve, Length, Domain
offset = OffsetCurve(Curve=intcrv.Curve, Distance=road_width, Plane=X_2, Corners=1)
repeat = RepeatData(Data="300", Length="10")
intcrv_2 = Interpolate(Vertices=rotate.Geometry, Degree=3, Periodic=False, KnotStyle=1)  # -> Curve, Length, Domain
extr = Extrude(Base=intcrv.Curve, Direction=Z_2)
division_2 = Division(A=road_width, B="2")
end = EndPoints(Curve=intcrv.Curve)  # -> Start, End
end_2 = EndPoints(Curve=offset)  # -> Start, End
merge = Merge(Data1=flatten(repeat), Data2=flatten("1000"))
extr_2 = Extrude(Base=offset, Direction=Z_2)
len = Length(Curve=intcrv_2.Curve)
pt_3 = Point(end.Start)
pt_4 = Point(end_2.Start)
number_slider = Slider(-10, range=-10..0)
ma = MassAddition(Input=merge)  # -> Result, PartialResults
division_3 = Division(A=ma.PartialResults, B=len)
Z_3 = UnitZ(Factor=division_2)
addition = Addition(A=pt_3, B=pt_4)
shatter = Shatter(Curve=reparameterize(intcrv_2.Curve), Parameters=division_3)
X_3 = UnitX(Factor=1)
division_4 = Division(A=addition, B="2")
offset_2 = OffsetSurface(Surface=extr, Distance=number_slider, Retrim=True)
neg = Negative(Value=Z_3)
neg_2 = Negative(Value=number_slider)
loft = Loft(
    Curves=[offset_2, extr],
    Options={Adjust=False, Closed=False, LoftEnds=0, LoftSimp=0, LoftType=0, Rebuild=10, Refit=0.01})
move_3 = Move(Geometry=division_4, Motion=neg)  # -> Geometry, Transform
cull_i = CullIndex(List=shatter, Indices="-1", Wrap=True)
offset_3 = OffsetSurface(Surface=extr_2, Distance=neg_2, Retrim=True)
offset_4 = OffsetCurve(Curve=shatter, Distance=road_width, Plane=X_3, Corners=1)  # -> flatten(Curve)
arc = Arc3Pt(PointA=pt_3, PointB=move_3.Geometry, PointC=pt_4)  # -> Arc, Plane, Radius
swp2 = Sweep2(Rail1=intcrv.Curve, Rail2=offset, Sections=arc.Arc, SameHeight=False)
loft_2 = Loft(
    Curves=[extr_2, offset_3],
    Options={Adjust=False, Closed=False, LoftEnds=0, LoftSimp=0, LoftType=0, Rebuild=10, Refit=0.01})
rulesrf = RuledSurface(CurveA=cull_i, CurveB=offset_4)
offset_5 = OffsetSurface(Surface=swp2, Distance=number_slider, Retrim=True)
lng = ListLength(List=rulesrf)
loft_3 = Loft(
    Curves=[swp2, offset_5],
    Options={Adjust=False, Closed=False, LoftEnds=0, LoftSimp=0, LoftType=0, Rebuild=10, Refit=0.01})
series_3 = Series(Start="150", Step="150", Count=lng)
tread_depth = Slider(300, range=0..500)
Z_4 = UnitZ(Factor=series_3)
panel = Panel(series_3)
number_slider_2 = Slider(-275.922, range=-2000..0.001)
move_4 = Move(Geometry=rulesrf, Motion=Z_4)  # -> Geometry, Transform
division_5 = Division(A=road_width, B="2")
division_6 = Division(A=tread_depth, B="2")
ellipse = Ellipse(Plane=PlaneXY(0, 0, 0), Radius1=division_6, Radius2=division_5)  # -> Ellipse, Focus1, Focus2
number_slider_3 = Slider(100, range=0..100)
Z_5 = UnitZ(Factor=number_slider_3)
neg_3 = Negative(Value=Z_5)
extr_3 = Extrude(Base=ellipse.Ellipse, Direction=neg_3)
cap = CapHoles(Brep=extr_3)
geo = Geometry(cap)
brep = Brep(geo)
bbox = BoundingBox(Content=geo, Plane=PlaneXY(0, 0, 0))  # -> Box, Box_2
popgeo = PopulateGeometry(Geometry=brep, Count=Slider(145, range=0..500), Seed=1)
volume = Volume(Geometry=bbox.Box_2)  # -> Volume, Centroid
scale = Scale(Geometry=bbox.Box, Center=volume.Centroid, Factor=Slider(1, range=0..10))  # -> Geometry, Transform
pop3d = Populate3D(Region=scale.Geometry, Count=Slider(76, range=0..500), Seed=1, Points=popgeo)
merge_2 = Merge(Data1=pop3d, Data2=popgeo)
brep_2 = Brep(geo)
brepinc = PointInBrep(Brep=brep_2, Point=merge_2, Strict=False)
cull = CullPattern(List=merge_2, CullPattern=brepinc)
sbox = SurfaceBox(Surface=move_4.Geometry, Domain=move_4.Geometry, Height=number_slider_3)
panel_2 = Panel(brepinc)
voronoi³ = Voronoi3D(Points=cull)  # -> Cells, Boundary
bbx = BrepBrep(BrepA=voronoi³.Cells, BrepB=geo)  # -> Curves, Points
explode = Explode(Curve=bbx.Curves, Recursive=True)  # -> Segments, Vertices
pipe = Pipe(Curve=explode.Segments, Radius=Slider(5, range=0..10), Caps=0)
geo_2 = Geometry(pipe)
morph = BoxMorph(Geometry=geo_2, Reference=bbox.Box, Target=sbox)
