# Grasshopper definition grasshopper stairs.gh (Grasshopper 1.0.8)

material_thickness = Slider(5, range=0..10)
pole_width = Slider(100, range=0..1000)
pole_height = Slider(3000, range=0..10000)
B = Slider(2, range=0..10)
stair_width = Slider(148, range=0..300)
pole_diameter = Slider(200, range=0..300)
stair_length = Slider(502, range=0..1500)
pole_diameter_2 = Slider(223, range=0..300)
Z = UnitZ(Factor=1)
pt = Point(<point referenced from the Rhino model>)
pi = Pi(Factor=Slider(2, range=0..10))
subtraction = Subtraction(A=pole_width, B=material_thickness)
multiplication = Multiplication(A=stair_width, B=Slider(2, range=0..10))
pt_2 = Point(<point referenced from the Rhino model>)
multiplication_2 = Multiplication(A=stair_length, B=Slider(2, range=0..10))
line = LineSDL(Start=pt, Direction=Z, Length=pole_height)
division = Division(A=pole_diameter, B=Slider(2, range=0..10))
range = Range(Domain=pi, Steps=Slider(20, range=0..100))
pt_3 = Point(<point referenced from the Rhino model>)
multiplication_3 = Multiplication(A=pole_width, B=B)
multiplication_4 = Multiplication(A=subtraction, B=B)
addition = Addition(A=division, B=pole_diameter_2)
no_of_stairs = Slider(18, range=0..100)
ellipse = Ellipse(Plane=pt_2, Radius1=multiplication_2, Radius2=multiplication)  # -> Ellipse, Focus1, Focus2
pipe = Pipe(Curve=line, Radius=division, Caps=0)  # -> flatten(Pipe)
thread_height = Slider(161, range=0..1000)
no_of_stairs_2 = Slider(27, range=0..100)
division_2 = Division(A=material_thickness, B=pole_width)
tread_height = Slider(150, range=0..1000)
circle = CircleCNR(Center=pt_3, Normal=Vector(0, 0, 1), Radius=multiplication_3)
arc = Arc(Plane=PlaneXY(0, 0, 0), Radius=addition, Angle=range)  # -> Arc, Length
crv = Curve(<curve referenced from the Rhino model>)
circle_2 = CircleCNR(Center=pt_3, Normal=Vector(0, 0, 1), Radius=multiplication_4)
subtraction_2 = Subtraction(A=Slider(1, range=0..1), B=division_2)
loft = Loft(
    Curves=[circle_2, circle],
    Options={Adjust=False, Closed=False, LoftEnds=0, LoftSimp=0, LoftType=0, Rebuild=10, Refit=0.01})
Z_2 = UnitZ(Factor=thread_height)
arrcurve = CurveArray(Geometry=ellipse.Ellipse, Curve=crv, Count=no_of_stairs)  # -> Geometry, Transform
thickness_of_stair = Slider(100, range=0..100)
series = Series(Start=0, Step=tread_height, Count=no_of_stairs)
extr = Extrude(Base=loft, Direction=Z_2)
series_2 = Series(Start=0, Step=thread_height, Count=no_of_stairs_2)
Z_3 = UnitZ(Factor=series)
Z_4 = UnitZ(Factor=series_2)
Z_5 = UnitZ(Factor=thickness_of_stair)
extr_2 = Extrude(Base=arrcurve.Geometry, Direction=Z_5)
railing_radius = Slider(30, range=0..100)
rev = Reverse(Vector=Z_4)
cap = CapHoles(Brep=extr_2)
move = Move(Geometry=cap, Motion=Z_3)  # -> Geometry, Transform
area = Area(Geometry=move.Geometry)  # -> Area, Centroid
cir = Circle(Plane=area.Centroid, Radius=railing_radius)
move_2 = Move(Geometry=extr, Motion=rev)  # -> Geometry, Transform
swp1 = Sweep1(Sections=cir, Miter=1)
