# Grasshopper definition gyroid 3d reefs.gh (Grasshopper 1.0.8)
# plug-ins: Jellyfish

pt = Point(Point(4024.866551, -11.50687005, 0))
number_slider = Slider(50, range=0..50)
pt_2 = Point(Point(4024.866551, -11.50687005, 0))
pt_3 = Point(Point(4024.866551, -11.50687005, 0))
number_slider_2 = Slider(50, range=0..50)
number_slider_3 = Slider(50, range=0..50)
number_slider_4 = Slider(30, range=0..40)
xy = XYPlane(Origin=pt)
number_slider_5 = Slider(30, range=0..30)
number_slider_6 = Slider(30, range=0..30)
xy_2 = XYPlane(Origin=pt_2)
xy_3 = XYPlane(Origin=pt_3)
box = CenterBox(Base=xy, X=number_slider, Y=number_slider, Z=number_slider)
box_2 = Box({Plane=Plane(origin=(73.06744308, 225.3586832, 0), x=(1, 0, 0), y=(0, -1, 0)), X=Domain(0, 670.907606), Y=Domain(0, 638.1003881), Z=Domain(-10, 0)})
pt_4 = Point([Point(156.7258487, 153.1828038, 0), Point(146.8836833, 67.88403731, 0), Point(182.6107436, -22.3358119, 0), Point(182.971623, -173.2490142, 0), Point(384.7360131, -194.9585737, 0), Point(504.4823584, -138.8014354, 0), Point(355.209517, -20.69545101, 0), Point(399.4992611, 108.8930597, 0), Point(561.8949897, 94.12981162, 0), Point(494.640193, -15.77436832, 0), Point(699.6853049, -96.15205217, 0), Point(709.5274702, 39.9979021, 0), Point(696.4045831, 167.9460519, 0), Point(535.6492154, -284.7935551, 0), Point(673.4395306, -330.7236601, 0), Point(325.6830209, -358.6097953, 18.44164234), Point(148.5240442, -299.5568031, 0), Point(138.6818789, -353.6887126, 0), Point(289.5950812, -276.5917506, 0), Point(540.5702981, -94.51169127, 0)])
box_3 = CenterBox(Base=xy_2, X=number_slider_2, Y=number_slider_2, Z=number_slider_2)
box_4 = CenterBox(Base=xy_3, X=number_slider_3, Y=number_slider_3, Z=number_slider_3)
merge = Merge(Data1=Slider(20, range=1..100), Data2=Slider(30, range=1..100), Data3=Slider(44.257, range=1..100))
gyroid = Gyroid(BoundingBox=box, Fx=number_slider_4, Fy=number_slider_4, Fz=number_slider_4)
gyroid_2 = Gyroid(BoundingBox=box_3, Fx=number_slider_5, Fy=number_slider_5, Fz=number_slider_5)
gyroid_3 = Gyroid(BoundingBox=box_4, Fx=number_slider_6, Fy=number_slider_6, Fz=number_slider_6)
implicitsphere = ImplicitSphere(Center=pt_4, Radius=merge)
implicitbox = ImplicitBox(Box=box_2)
scale = Scale(Function=gyroid, Center=pt, ScaleFactor=Slider(5, range=0..100))
srf = Surface(<surface referenced from the Rhino model>)
scale_2 = Scale(Function=gyroid_2, Center=pt_2, ScaleFactor=Slider(5, range=0..100))
scale_3 = Scale(Function=gyroid_3, Center=pt_3, ScaleFactor=Slider(5, range=0..100))
srf_2 = Surface(<surface referenced from the Rhino model>)
Z = UnitZ(Factor=Slider(1, range=0..1))
srf_3 = Surface([<surface referenced from the Rhino model> x2])
Z_2 = UnitZ(Factor=Slider(1, range=0..1))
isosurface = IsoSurface(Function=scale, Resolution=Slider(200, range=20..200), IsoValue=0, Parallel=True, ExpandBox=0)  # -> Mesh, CellSize
Z_3 = UnitZ(Factor=Slider(1, range=0..1))
extr = Extrude(Base=srf, Direction=Z)
implicitnarysmoothdifference = ImplicitNarySmoothDifference(FunctionA=implicitbox, FunctionB=implicitsphere, Strength=Slider(20, range=0..50))
isosurface_2 = IsoSurface(Function=scale_2, Resolution=Slider(200, range=20..200), IsoValue=0, Parallel=True, ExpandBox=0)  # -> Mesh, CellSize
isosurface_3 = IsoSurface(Function=scale_3, Resolution=Slider(200, range=20..200), IsoValue=0, Parallel=True, ExpandBox=0)  # -> Mesh, CellSize
extr_2 = Extrude(Base=srf_2, Direction=Z_2)
extr_3 = Extrude(Base=srf_3, Direction=Z_3)
mesh = MeshBrep(
    Brep=extr,
    Settings={GridMaxCount=0, GridMinCount=12, JaggedSeams=False, MaxEdgeLength=0, MinEdgeLength=0.0001, MinTolerance=0, Refine=True, RefineAngle=0, RelativeTolerance=0.65, SimplePlanes=True, Tolerance=0})
isosurface_4 = IsoSurface(
    Function=implicitnarysmoothdifference,
    Resolution=Slider(80, range=0..100),
    IsoValue=0,
    Parallel=True,
    ExpandBox=Slider(5, range=0..10))  # -> Mesh, CellSize
mesh_2 = Mesh(extr_3)
mesh_3 = MeshBrep(
    Brep=extr_2,
    Settings={GridMaxCount=0, GridMinCount=16, JaggedSeams=False, MaxEdgeLength=0, MinEdgeLength=0.0001, MinTolerance=0, Refine=True, RefineAngle=0, RelativeTolerance=0.65, SimplePlanes=True, Tolerance=0})
meshmeshcut = MeshMeshCut(TargetMesh=isosurface.Mesh, CutMesh=mesh, RemoveInside=Toggle(False))
meshmeshcut_2 = MeshMeshCut(TargetMesh=isosurface_2.Mesh, CutMesh=mesh_3, RemoveInside=Toggle(False))
meshmeshcut_3 = MeshMeshCut(TargetMesh=isosurface_3.Mesh, CutMesh=mesh_2, RemoveInside=Toggle(False))
mesh_4 = Mesh(meshmeshcut)
mesh_5 = Mesh(meshmeshcut_2)
mesh_6 = Mesh(meshmeshcut_3)
