# Grasshopper definition kangaroo pavilion.gh (Grasshopper 1.0.8)
# plug-ins: Kangaroo2 Components

rectangle = Rectangle(Plane=PlaneXY(0, 0, 0), XSize=Slider(35, range=0..100), YSize=Slider(70, range=0..100), Radius=0)  # -> Rectangle, Length
mesh_plane = MeshPlane(Boundary=rectangle.Rectangle, WidthCount=Slider(25, range=0..100), HeightCount=Slider(50, range=0..100))  # -> Mesh, Area

mesh = Mesh(mesh_plane.Mesh)

nakedvertices = NakedVertices(Mesh=mesh)  # -> ClothedIndex, NakedIndex, ClothedPts, NakedPts
point = Point([Point(5.607719962, -0.03139020655, 0), Point(28.04957147, -0.03139020655, 0), Point(34.9699269, 7.009717647, 0), Point(34.9699269, 30.65445052, 0), Point(34.9699269, 58.82674575, 0), Point(29.40076985, 70.02609362, 0), Point(7.628405213, 70.02609362, 0), Point(-0.04890489601, 54.50869427, 0), Point(-0.04890489601, 11.2313044, 0), Point(5.60709751, -0.0361352275, 0)])
sphere = Sphere(Base=point, Radius=Slider(2, range=0..10))
point_2 = Point(nakedvertices.NakedPts)
point_in_breps = PointInBreps(Brep=sphere, Point=point_2, Strict=False)  # -> Inside, Index
dispatch = Dispatch(List=point_2, DispatchPattern=point_in_breps.Inside)  # -> ListA, ListB
# points inside of sphere
point_3 = Point(dispatch.ListA)
# points outside of sphere
point_4 = Point(dispatch.ListB)

deconstruct_mesh = DeconstructMesh(Mesh=mesh)  # -> Vertices, Faces, Colours, Normals
unit_z = UnitZ(Factor=Slider(0.15, range=0..1))
edgelengths = EdgeLengths(Mesh=mesh, LengthFactor=Slider(0.15, range=0..1), Strength=1)
load = Load(Point=deconstruct_mesh.Vertices, ForceVector=unit_z, Weighting=1)
show = Show(G=mesh)
anchorxyz = AnchorXYZ(Point=point_4, X=Toggle(False), Y=Toggle(False), Z=Toggle(True), Strength=1000)
anchor = Anchor(Point=point_3, Strength=Slider(75, range=0..100))
merge = Merge(Data1=show, Data2=edgelengths, Data3=load, Data4=anchor)
bouncysolver = BouncySolver(GoalObjects=merge, Reset=Button(), Threshold=1e-15, Tolerance=0.0001, Damping=0.99, Iterations=10, On=Toggle(True))  # -> I, V, O
list_item = ListItem(List=bouncysolver.O, Index=0, Wrap=True)
