# Grasshopper definition pavillion_autosave1_autosave.gh (Grasshopper 1.0.8)
# plug-ins: MeshEdit Components, Weaverbird, Kangaroo2 Components

number_slider = Slider(500, range=0..1000)
multiplication = Multiplication(A=number_slider, B="1")
multiplication_2 = Multiplication(A=number_slider, B="3")
multiplication_3 = Multiplication(A=number_slider, B="2")
unit_z = UnitZ(Factor=multiplication_2)
multiplication_4 = Multiplication(A=number_slider, B="4")
multiplication_5 = Multiplication(A=number_slider, B="2")
unit_z_2 = UnitZ(Factor=multiplication)
multiplication_6 = Multiplication(A=number_slider, B="3")
unit_z_3 = UnitZ(Factor=multiplication_3)
unit_z_4 = UnitZ(Factor=multiplication_4)
curve = Curve(<curve referenced from the Rhino model>)
unit_z_5 = UnitZ(Factor=multiplication_5)
curve_2 = Curve(<curve referenced from the Rhino model>)
panel = Panel("""5000
-5000""")
unit_z_6 = UnitZ(Factor=multiplication_6)
curve_3 = Curve(<curve referenced from the Rhino model>)
curve_4 = Curve(<curve referenced from the Rhino model>)
curve_5 = Curve(<curve referenced from the Rhino model>)
curve_6 = Curve(<curve referenced from the Rhino model>)
curve_7 = Curve(<curve referenced from the Rhino model>)
curve_8 = Curve(<curve referenced from the Rhino model>)
unit_z_7 = UnitZ(Factor=number_slider)
curve_9 = Curve(<curve referenced from the Rhino model>)
curve_10 = Curve(<curve referenced from the Rhino model>)
curve_11 = Curve(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)
curve_12 = Curve(<curve referenced from the Rhino model>)
curve_13 = Curve([<curve referenced from the Rhino model> x4])
curve_14 = Curve(<curve referenced from the Rhino model>)
curve_15 = Curve(<curve referenced from the Rhino model>)
curve_16 = Curve(<curve referenced from the Rhino model>)
curve_17 = Curve(<curve referenced from the Rhino model>)
point = Point(<point referenced from the Rhino model>)
end_points = EndPoints(Curve=curve_2)  # -> Start, End
end_points_2 = EndPoints(Curve=curve)  # -> Start, End
end_points_3 = EndPoints(Curve=curve_8)  # -> Start, End
end_points_4 = EndPoints(Curve=curve_11)  # -> Start, End
end_points_5 = EndPoints(Curve=curve_10)  # -> Start, End
point_2 = Point(<point referenced from the Rhino model>)
end_points_6 = EndPoints(Curve=curve_4)  # -> Start, End
end_points_7 = EndPoints(Curve=curve_3)  # -> Start, End
end_points_8 = EndPoints(Curve=curve_5)  # -> Start, End
curve_18 = Curve(<curve referenced from the Rhino model>)
end_points_9 = EndPoints(Curve=curve_14)  # -> Start, End
curve_19 = Curve(<curve referenced from the Rhino model>)
curve_20 = Curve(<curve referenced from the Rhino model>)
end_points_10 = EndPoints(Curve=curve_6)  # -> Start, End
end_points_11 = EndPoints(Curve=curve_12)  # -> Start, End
curve_21 = Curve(<curve referenced from the Rhino model>)
end_points_12 = EndPoints(Curve=curve_9)  # -> Start, End
curve_22 = Curve(<curve referenced from the Rhino model>)
curve_23 = Curve(<curve referenced from the Rhino model>)
explode = Explode(Curve=curve_13, Recursive=True)  # -> flatten(Segments), Vertices
curve_24 = Curve(<curve referenced from the Rhino model>)
curve_25 = Curve(<curve referenced from the Rhino model>)
curve_26 = Curve(<curve referenced from the Rhino model>)
offset_curve = OffsetCurve(Curve=graft(curve_13), Distance=panel, Corners=1)  # -> simplify(Curve)
boundary_surfaces = BoundarySurfaces(Edges=[curve_16, curve_17])
xy_plane = XYPlane(Origin=point)
xy_plane_2 = XYPlane(Origin=point_2)
line = Line(StartPoint=end_points_4.Start, EndPoint=end_points_9.Start)
line_2 = Line(StartPoint=end_points_7.End, EndPoint=end_points_3.End)
line_3 = Line(StartPoint=end_points_3.End, EndPoint=end_points_4.End)
line_4 = Line(StartPoint=end_points.Start, EndPoint=end_points_2.Start)
line_5 = Line(StartPoint=end_points.End, EndPoint=end_points_2.End)
line_6 = Line(StartPoint=end_points_4.Start, EndPoint=end_points_11.End)
line_7 = Line(StartPoint=end_points_2.End, EndPoint=end_points_8.End)
line_8 = Line(StartPoint=end_points_7.End, EndPoint=end_points_5.Start)
line_9 = Line(StartPoint=end_points_12.Start, EndPoint=end_points_7.Start)
line_10 = Line(StartPoint=end_points_10.End, EndPoint=end_points_5.End)
line_11 = Line(StartPoint=end_points_2.Start, EndPoint=end_points_8.Start)
line_12 = Line(StartPoint=end_points_12.End, EndPoint=end_points_10.Start)
line_13 = Line(StartPoint=end_points_8.Start, EndPoint=end_points_12.Start)
line_14 = Line(StartPoint=end_points_8.End, EndPoint=end_points_12.End)
extrude = Extrude(Base=boundary_surfaces, Direction=unit_z_2)
number_slider_2 = Slider(6, range=0..10)
trim_tree = TrimTree(Tree=offset_curve, Depth=1)
number_slider_3 = Slider(6, range=0..10)
center_box = CenterBox(Base=xy_plane, X=Slider(10000, range=0..10000), Y=Slider(10000, range=0..10000), Z=Slider(10000, range=0..10000))
center_box_2 = CenterBox(Base=xy_plane_2, X=Slider(9370, range=0..10000), Y=Slider(8268, range=0..10000), Z=Slider(8110, range=0..10000))
curve_27 = Curve(explode.Segments)
boundary_surfaces_2 = BoundarySurfaces(Edges=flatten([line_5, curve_2, curve, line_4]))
boundary_surfaces_3 = BoundarySurfaces(Edges=flatten([line_7, curve, line_11, curve_5]))
boundary_surfaces_4 = BoundarySurfaces(Edges=[line_6, curve_11, curve_15, curve_12])
boundary_surfaces_5 = BoundarySurfaces(Edges=flatten([curve_5, line_14, curve_9, line_13]))
boundary_surfaces_6 = BoundarySurfaces(Edges=[curve_8, line_3, curve_11, line, curve_14])
boundary_surfaces_7 = BoundarySurfaces(Edges=[line_2, curve_8, curve_7, curve_3])
list_length = ListLength(List=curve_27)
loft = Loft(Curves=trim_tree, Options={Adjust=False, Closed=False, LoftEnds=0, LoftSimp=0, LoftType=0, Rebuild=10, Refit=0.01})
multiple_curves = MultipleCurves(Curves=curve_27)  # -> Points, IndexA, IndexB, ParamA, ParamB
boundary_surfaces_8 = BoundarySurfaces(Edges=flatten([line_10, curve_6, line_12, curve_9, line_9, curve_3, line_8, curve_10]))
boundary_surfaces_9 = BoundarySurfaces(Edges=curve_4)
mesh_box = MeshBox(Base=center_box, XCount=number_slider_2, YCount=number_slider_2, ZCount=number_slider_2)
extrude_2 = Extrude(Base=boundary_surfaces_3, Direction=unit_z_5)
mesh_box_2 = MeshBox(Base=center_box_2, XCount=number_slider_3, YCount=number_slider_3, ZCount=number_slider_3)
extrude_3 = Extrude(Base=boundary_surfaces_2, Direction=unit_z_7)
extrude_4 = Extrude(Base=boundary_surfaces_5, Direction=unit_z_6)
series = Series(Start=0, Step=1, Count=list_length)
extrude_5 = Extrude(Base=boundary_surfaces_4, Direction=unit_z_2)
curve_28 = Curve(loft)
extrude_6 = Extrude(Base=boundary_surfaces_6, Direction=unit_z_3)
extrude_7 = Extrude(Base=boundary_surfaces_7, Direction=unit_z)
extrude_8 = Extrude(Base=boundary_surfaces_8, Direction=unit_z_4)
merge = Merge(Data1=multiple_curves.IndexA, Data2=multiple_curves.IndexB)
merge_2 = Merge(Data1=multiple_curves.ParamA, Data2=multiple_curves.ParamB)
extrude_9 = Extrude(Base=boundary_surfaces_9, Direction=unit_z)
region_union = RegionUnion(Curves=flatten(curve_28))
equality = Equality(FirstNumber=merge, SecondNumber=graft(series))  # -> Equality, Inequality
subd_fuse = SubDFuse(SubDA=mesh_box, SubDB=mesh_box_2, BooleanOption=Slider(0, range=0..3), Smoothing=Slider(1.298, range=0..10))
boundary_surfaces_10 = BoundarySurfaces(Edges=region_union)
dispatch = Dispatch(List=merge_2, DispatchPattern=equality.Equality)  # -> ListA, ListB
subd_from_mesh = SubDFromMesh(Mesh=mesh_box_2, Creases=1, Corners=1, Interpolate=False)
subd_from_mesh_2 = SubDFromMesh(Mesh=mesh_box, Creases=1, Corners=1, Interpolate=False)
panel_2 = Panel(subd_fuse)
unit_z_8 = UnitZ(Factor=Slider(2000, range=0..2000))
null_item = NullItem(Item=subd_fuse)  # -> NullFlags, InvalidFlags, Description
surface = Surface(boundary_surfaces_10)
shatter = Shatter(Curve=graft(curve_27), Parameters=dispatch.ListA)
curve_29 = Curve(<curve referenced from the Rhino model>)
boundary_surfaces_11 = BoundarySurfaces(Edges=curve_29)
unit_z_9 = UnitZ(Factor=Slider(200, range=0..1000))
extrude_10 = Extrude(Base=boundary_surfaces_11, Direction=unit_z_8)
mesh_difference = MeshDifference(MeshesA=[extrude_6, extrude_5, extrude_7, extrude_8, extrude_4, extrude_2, extrude_3, extrude], MeshesB=extrude_10)
panel_3 = Panel(null_item.NullFlags)
deconstruct_brep = DeconstructBrep(Brep=surface)  # -> Faces, Edges, Vertices
merge_3 = Merge(Data1=subd_from_mesh_2, Data2=subd_from_mesh)
curve_30 = Curve(shatter)
offset_curve_2 = OffsetCurve(Curve=curve_12, Distance=Slider(300, range=0..1000), Corners=1)
extrude_11 = Extrude(Base=boundary_surfaces_11, Direction=unit_z_9)
curve_curve = CurveCurve(CurveA=curve_29, CurveB=offset_curve_2)  # -> Points, ParamsA, ParamsB
end_points_13 = EndPoints(Curve=curve_30)  # -> Start, End
rectangle = Rectangle(Plane=PlaneXY(0, 0, 0), XSize=Slider(16090, range=0..20000), YSize=Slider(20000, range=0..20000), Radius=0)  # -> Rectangle, Length
stream_filter = StreamFilter(Gate=panel_3, Stream0=subd_fuse, Stream1=merge_3)
point_3 = Point(flatten([end_points_13.End, end_points_13.Start]))
shatter_2 = Shatter(Curve=offset_curve_2, Parameters=curve_curve.ParamsB)
shatter_3 = Shatter(Curve=curve_29, Parameters=curve_curve.ParamsA)
settings_custom = SettingsCustom(
    StitchSeams=True,
    SimplePlanes=False,
    Refine=True,
    MinCount=16,
    MaxCount=400,
    AspectRatio=20,
    MaxDistance=0,
    MaxAngle=20,
    MinEdge=0,
    MaxEdge=0)
panel_4 = Panel("""1
3""")
mesh_plane = MeshPlane(Boundary=rectangle.Rectangle, WidthCount=Slider(21, range=0..100), HeightCount=Slider(38, range=0..100))  # -> Mesh, Area
point_groups = PointGroups(Points=point_3, Distance="0.01")  # -> Groups, Indices
panel_5 = Panel("""-1
1
3""")
cull_index = CullIndex(List=shatter_2, Indices=panel_4, Wrap=True)
cull_index_2 = CullIndex(List=shatter_3, Indices=panel_5, Wrap=True)
list_item = ListItem(List=shatter_3, Index="4", Wrap=True)
mesh_brep = MeshBrep(Brep=surface, Settings=settings_custom)
point_4 = Point(point_groups.Groups)
number_slider_4 = Slider(1200, range=0..10000)
mesh = Mesh(mesh_plane.Mesh)
list_item_2 = ListItem(List=shatter_3, Index="2", Wrap=True)
move = Move(Geometry=cull_index_2, Motion=unit_z_9)  # -> Geometry, Transform
prune_tree = PruneTree(Tree=point_4, Minimum="2", Maximum="10")
divide_curve = DivideCurve(Curve=list_item, Count=10, Kinks=False)  # -> Points, Tangents, Parameters
nakedvertices = NakedVertices(Mesh=mesh)  # -> ClothedIndex, NakedIndex, ClothedPts, NakedPts
end_points_14 = EndPoints(Curve=list_item_2)  # -> Start, End
move_2 = Move(Geometry=cull_index, Motion=unit_z_2)  # -> Geometry, Transform
negative = Negative(Value=Slider(100, range=0..100))
unit_z_10 = UnitZ(Factor=number_slider_4)
point_5 = Point([<point referenced from the Rhino model> x6])
list_item_3 = ListItem(List=prune_tree, Index=0, Wrap=True)
list_length_2 = ListLength(List=prune_tree)
line_15 = Line(StartPoint=end_points_14.Start, EndPoint=end_points_14.End)
point_6 = Point(nakedvertices.NakedPts)
list_item_4 = ListItem(List=divide_curve.Points, Index="6", Wrap=True)
sphere = Sphere(Base=point_5, Radius=Slider(2512, range=0..10000))
offset_curve_3 = OffsetCurve(Curve=move.Geometry, Distance=negative, Corners=1)
list_item_5 = ListItem(List=divide_curve.Points, Index="1", Wrap=True)
point_7 = Point(deconstruct_brep.Vertices)
deconstruct_mesh = DeconstructMesh(Mesh=mesh)  # -> Vertices, Faces, Colours, Normals
extrude_12 = Extrude(Base=move_2.Geometry, Direction=unit_z_10)
point_8 = Point(list_item_3)
list_item_6 = ListItem(List=shatter_3, Index="0", Wrap=True)
unit_x = UnitX(Factor=negative)
curve_closest_point = CurveClosestPoint(Point=list_item_4, Curve=list_item)  # -> Point, Parameter, Distance
divide_curve_2 = DivideCurve(Curve=line_15, Count=10, Kinks=False)  # -> Points, Tangents, Parameters
curve_closest_point_2 = CurveClosestPoint(Point=list_item_5, Curve=list_item)  # -> Point, Parameter, Distance
point_in_breps = PointInBreps(Brep=sphere, Point=point_6, Strict=False)  # -> Inside, Index
end_points_15 = EndPoints(Curve=list_item_6)  # -> Start, End
closest_points = ClosestPoints(Point=point_8, Cloud=point_7, Count=list_length_2)  # -> ClosestPoint, CPIndex, Distance
dispatch_2 = Dispatch(List=point_6, DispatchPattern=point_in_breps.Inside)  # -> ListA, ListB
list_item_7 = ListItem(List=divide_curve_2.Points, Index="3", Wrap=True)
extrude_13 = Extrude(Base=extrude_12, Direction=unit_x)
shatter_4 = Shatter(Curve=list_item, Parameters=[curve_closest_point.Parameter, curve_closest_point_2.Parameter])
list_item_8 = ListItem(List=divide_curve_2.Points, Index="9", Wrap=True)
list_item_9 = ListItem(List=divide_curve_2.Points, Index="6", Wrap=True)
line_16 = Line(StartPoint=end_points_15.Start, EndPoint=end_points_15.End)
point_9 = Point(closest_points.ClosestPoint)
curve_closest_point_3 = CurveClosestPoint(Point=list_item_8, Curve=list_item_2)  # -> Point, Parameter, Distance
curve_closest_point_4 = CurveClosestPoint(Point=list_item_7, Curve=list_item_2)  # -> Point, Parameter, Distance
shatter_5 = Shatter(Curve=list_item_2, Parameters=flatten([curve_closest_point_4.Parameter, curve_closest_point_3.Parameter]))
point_10 = Point(dispatch_2.ListB)
point_11 = Point(dispatch_2.ListA)
addition = Addition(A=number_slider_4, B=Slider(463, range=0..1000))
unit_z_11 = UnitZ(Factor=Slider(44.9, range=0..100))
line_17 = Line(StartPoint=point_8, EndPoint=point_9)
list_item_10 = ListItem(List=shatter_4, Index="0", Wrap=True)
list_item_11 = ListItem(List=shatter_4, Index="2", Wrap=True)
divide_curve_3 = DivideCurve(Curve=line_16, Count=10, Kinks=False)  # -> Points, Tangents, Parameters
panel_6 = Panel("""0
2""")
xy_plane_3 = XYPlane(Origin=Point(0, 0, 0))
surface_2 = Surface(surface)
list_item_12 = ListItem(List=shatter_5, Index="1", Wrap=True)
point_on_curve = PointOnCurve(list_item_12, parameter=0.654)
line_18 = Line(StartPoint=list_item_9, EndPoint=point_on_curve)
load = Load(Point=deconstruct_mesh.Vertices, ForceVector=unit_z_11, Weighting=1)
unit_z_12 = UnitZ(Factor=addition)
line_19 = Line(line_17)
edgelengths = EdgeLengths(Mesh=mesh, LengthFactor=Slider(0.5, range=0..1), Strength=1)
line_20 = Line(StartPoint=curve_closest_point_3.Point, EndPoint=curve_closest_point_4.Point)
anchor = Anchor(Point=point_11, Strength=Slider(236, range=0..1000))
show = Show(G=mesh)
list_item_13 = ListItem(List=shatter_5, Index=panel_6, Wrap=True)
list_item_14 = ListItem(List=divide_curve_3.Points, Index="6", Wrap=True)
list_item_15 = ListItem(List=divide_curve_3.Points, Index="1", Wrap=True)
sphere_2 = Sphere(Base=xy_plane_3, Radius=1)
anchorxyz = AnchorXYZ(Point=point_10, X=Toggle(False), Y=Toggle(False), Z=Toggle(True), Strength=Slider(113, range=0..1000))
curve_31 = Curve([curve_13, line_19])
extrude_14 = Extrude(Base=[list_item_10, list_item_11], Direction=unit_z_12)
extrude_15 = Extrude(Base=list_item_13, Direction=unit_z_12)
surface_split = SurfaceSplit(Surface=surface_2, Curves=flatten(curve_31))
curve_closest_point_5 = CurveClosestPoint(Point=list_item_15, Curve=list_item_6)  # -> Point, Parameter, Distance
curve_closest_point_6 = CurveClosestPoint(Point=list_item_14, Curve=list_item_6)  # -> Point, Parameter, Distance
merge_4 = Merge(Data1=flatten(load), Data2=flatten(show), Data3=flatten(edgelengths), Data4=flatten(anchor), Data5=flatten(anchorxyz))
extrude_16 = Extrude(Base=extrude_14, Direction=unit_x)
boundary_surfaces_12 = BoundarySurfaces(Edges=[line_20, list_item_12])
extrude_17 = Extrude(Base=extrude_15, Direction=unit_x)
surface_split_2 = SurfaceSplit(Surface=boundary_surfaces_12, Curves=line_18)
surface_3 = Surface(surface_split)
unit_z_13 = UnitZ(Factor=Slider(10190, range=0..15000))
line_21 = Line(StartPoint=curve_closest_point_6.Point, EndPoint=curve_closest_point_5.Point)
shatter_6 = Shatter(Curve=list_item_6, Parameters=[curve_closest_point_6.Parameter, curve_closest_point_5.Parameter])
simple_mesh = SimpleMesh(Brep=surface_3)
bouncysolver = BouncySolver(GoalObjects=merge_4, Reset=Button(), Threshold=1e-15, Tolerance=0.0001, Damping=0.99, Iterations=10, On=Toggle(False))  # -> I, V, O
point_on_curve_2 = PointOnCurve(list_item_12, parameter=0.793)
point_on_curve_3 = PointOnCurve(list_item_12, parameter=0.398)
extrude_18 = Extrude(Base=boundary_surfaces_12, Direction=unit_z_13)
list_item_16 = ListItem(List=surface_split_2, Index="1", Wrap=True)
list_item_17 = ListItem(List=shatter_6, Index="1", Wrap=True)
mesh_join = MeshJoin(Meshes=simple_mesh)
list_item_18 = ListItem(List=surface_split_2, Index="0", Wrap=True)
quad_remesh_settings = QuadRemeshSettings(
    TargetCount=Slider(1000, range=0..1000),
    AdaptiveSize=Slider(100, range=0..100),
    AdaptiveCount=True,
    HardEdges=True,
    SeamEdges=1,
    Symmetry=0,
    GuideCurves=2)
rebuild_curve = RebuildCurve(Curve=list_item_17, Count=10, Tangents=False)
boundary_surfaces_13 = BoundarySurfaces(Edges=[line_21, list_item_17])
boundary_surfaces_14 = BoundarySurfaces(Edges=[rebuild_curve, line_21])
mesh_weldvertices = MeshWeldVertices(Mesh=mesh_join, Tolerance=0.01)  # -> RuntimeMessage, Mesh
curve_closest_point_7 = CurveClosestPoint(Point=[point_on_curve_2, point_on_curve_3], Curve=list_item_12)  # -> Point, Parameter, Distance
area = Area(Geometry=list_item_16)  # -> Area, Centroid
area_2 = Area(Geometry=list_item_18)  # -> Area, Centroid
quad_remesh = QuadRemesh(Mesh=extrude_18, Settings={aqc=True, as=50, dhe=True, gci=0, null=False, pme=0, sa=0, tqc=2000})
unit_z_14 = UnitZ(Factor=Slider(10396, range=0..15000))
deconstruct_brep_2 = DeconstructBrep(Brep=list_item_18)  # -> Faces, Edges, Vertices
deconstruct_brep_3 = DeconstructBrep(Brep=list_item_16)  # -> Faces, Edges, Vertices
unit_z_15 = UnitZ(Factor=Slider(15000, range=0..15000))
deconstruct_brep_4 = DeconstructBrep(Brep=list_item_16)  # -> Faces, Edges, Vertices
mesh_2 = Mesh(boundary_surfaces_14)
mesh_unifynormals = MeshUnifyNormals(Mesh=mesh_weldvertices.Mesh)
mesh_edges = MeshEdges(Mesh=quad_remesh)  # -> NakedEdges, InteriorEdges, NonManifoldEdges
quad_remesh_2 = QuadRemesh(Mesh=mesh_2, Settings=quad_remesh_settings)
join_curves = JoinCurves(Curves=deconstruct_brep_3.Edges, Preserve=False)
move_3 = Move(Geometry=area.Centroid, Motion=unit_z_15)  # -> Geometry, Transform
move_4 = Move(Geometry=area_2.Centroid, Motion=unit_z_14)  # -> Geometry, Transform
subd_from_mesh_3 = SubDFromMesh(Mesh=quad_remesh, Creases=1, Corners=1, Interpolate=False)
shatter_7 = Shatter(Curve=list_item_12, Parameters=curve_closest_point_7.Parameter)
join_curves_2 = JoinCurves(Curves=deconstruct_brep_4.Edges, Preserve=False)
join_curves_3 = JoinCurves(Curves=deconstruct_brep_2.Faces, Preserve=False)
triremesh = TriRemesh(Geometry=mesh_2, Length=Slider(3000, range=0..10000), Iterations=25)  # -> Triangulation, Dual, Creases
mesh_3 = Mesh(mesh_unifynormals)
nakedvertices_2 = NakedVertices(Mesh=triremesh.Triangulation)  # -> ClothedIndex, NakedIndex, ClothedPts, NakedPts
list_item_19 = ListItem(List=divide_curve_2.Points, Index="7", Wrap=True)
point_12 = Point([Point(622165.4304, 517719.6457, 31.34109497), Point(623634.625, 519079.0625, 538.5571327), Point(626893.3125, 522519.2188, 7.965589523), Point(625765.5, 521328.1875, 10.37083244), Point(625712.4375, 522927.125, 268.5177298), Point(623033.75, 522144.5625, 274.0697212)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])
divide_curve_4 = DivideCurve(Curve=join_curves, Count=Slider(36, range=0..100), Kinks=False)  # -> Points, Tangents, Parameters
refine = Refine(Mesh=mesh_3, Level="3")
divide_curve_5 = DivideCurve(Curve=join_curves_2, Count=Slider(30, range=0..100), Kinks=False)  # -> Points, Tangents, Parameters
line_22 = Line(StartPoint=area.Centroid, EndPoint=move_3.Geometry)
divide_curve_6 = DivideCurve(Curve=join_curves_3, Count=Slider(19, range=0..100), Kinks=False)  # -> Points, Tangents, Parameters
sphere_3 = Sphere(Base=point_12, Radius=Slider(3458, range=0..10000))
point_13 = Point(nakedvertices_2.NakedPts)
mesh_4 = Mesh(refine)
surface_4 = Surface(surface_2)
interpolate = Interpolate(Vertices=divide_curve_4.Points, Degree=3, Periodic=True, KnotStyle=1)  # -> Curve, Length, Domain
curve_32 = Curve(curve_13)
interpolate_2 = Interpolate(Vertices=divide_curve_5.Points, Degree=3, Periodic=False, KnotStyle=1)  # -> Curve, Length, Domain
list_item_20 = ListItem(List=divide_curve_2.Points, Index="5", Wrap=True)
interpolate_3 = Interpolate(Vertices=divide_curve_6.Points, Degree=3, Periodic=True, KnotStyle=1)  # -> Curve, Length, Domain
curve_closest_point_8 = CurveClosestPoint(Point=list_item_19, Curve=interpolate_3.Curve)  # -> Point, Parameter, Distance
curve_closest_point_9 = CurveClosestPoint(Point=point_on_curve_2, Curve=interpolate_3.Curve)  # -> Point, Parameter, Distance
end_points_16 = EndPoints(Curve=curve_32)  # -> Start, End
deconstruct_brep_5 = DeconstructBrep(Brep=surface_4)  # -> Faces, Edges, Vertices
nakedvertices_3 = NakedVertices(Mesh=mesh_4)  # -> ClothedIndex, NakedIndex, ClothedPts, NakedPts
point_in_breps_2 = PointInBreps(Brep=sphere_3, Point=point_13, Strict=False)  # -> Inside, Index
curve_closest_point_10 = CurveClosestPoint(Point=list_item_20, Curve=interpolate.Curve)  # -> Point, Parameter, Distance
arc_3pt = Arc3Pt(PointA=curve_closest_point_9.Point, PointB=move_4.Geometry, PointC=curve_closest_point_8.Point)  # -> Arc, Plane, Radius
line_23 = Line(StartPoint=area_2.Centroid, EndPoint=move_4.Geometry)
arc_3pt_2 = Arc3Pt(PointA=point_on_curve_3, PointB=move_3.Geometry, PointC=curve_closest_point_10.Point)  # -> Arc, Plane, Radius
line_24 = Line(deconstruct_brep_5.Edges)
dispatch_3 = Dispatch(List=point_13, DispatchPattern=point_in_breps_2.Inside)  # -> ListA, ListB
curve_middle = CurveMiddle(Curve=line_24)
mesh_5 = Mesh(boundary_surfaces_12)
deconstruct_mesh_2 = DeconstructMesh(Mesh=triremesh.Triangulation)  # -> Vertices, Faces, Colours, Normals
rail_revolution = RailRevolution(Curve=arc_3pt.Arc, Rail=interpolate_3.Curve, Axis=line_23, Scale=Toggle(True))
rail_revolution_2 = RailRevolution(Curve=arc_3pt_2.Arc, Rail=interpolate.Curve, Axis=line_22, Scale=Toggle(True))
quad_remesh_3 = QuadRemesh(Mesh=mesh_5, Settings={aqc=True, as=50, dhe=True, gci=0, null=False, pme=0, sa=0, tqc=2000})
point_14 = Point(dispatch_3.ListB)
unit_z_16 = UnitZ(Factor=Slider(698, range=0..1000))
point_15 = Point(dispatch_3.ListA)
unit_z_17 = UnitZ(Factor=Slider(568.46, range=0..1000))
point_16 = Point(curve_middle)
point_17 = Point([end_points_16.End, end_points_16.Start])
point_18 = Point([<point referenced from the Rhino model> x5])
nakedvertices_4 = NakedVertices(Mesh=quad_remesh_3)  # -> ClothedIndex, NakedIndex, ClothedPts, NakedPts
point_19 = Point(<point referenced from the Rhino model>)
point_20 = Point([<point referenced from the Rhino model> x10])
extrude_19 = Extrude(Base=rail_revolution_2, Direction=unit_z_16)
unit_z_18 = UnitZ(Factor=Slider(500, range=0..1000))
sphere_4 = Sphere(Base=point_18, Radius=Slider(21872, range=0..50000))
closest_point = ClosestPoint(Point=simplify(graft(point_17)), Cloud=point_16)  # -> ClosestPoint, CPIndex, Distance
load_2 = Load(Point=deconstruct_mesh_2.Vertices, ForceVector=unit_z_17, Weighting=1)
sphere_5 = Sphere(Base=point_19, Radius=Slider(6000, range=0..50000))
sphere_6 = Sphere(Base=point_20, Radius=Slider(5477, range=0..10000))
edgelengths_2 = EdgeLengths(Mesh=triremesh.Triangulation, LengthFactor=Slider(0.4, range=0..1), Strength=1)
anchor_2 = Anchor(Point=point_15, Strength=Slider(99, range=0..1000))
show_2 = Show(G=triremesh.Triangulation)
point_21 = Point(nakedvertices_4.NakedPts)
anchorxyz_2 = AnchorXYZ(Point=point_14, X=Toggle(False), Y=Toggle(False), Z=Toggle(False), Strength=Slider(210, range=0..1000))
extrude_20 = Extrude(Base=rail_revolution, Direction=unit_z_18)
quad_remesh_4 = QuadRemesh(Mesh=extrude_19, Settings={aqc=True, as=50, dhe=True, gci=0, null=False, pme=0, sa=0, tqc=2000})
deconstruct_mesh_3 = DeconstructMesh(Mesh=quad_remesh_3)  # -> Vertices, Faces, Colours, Normals
list_item_21 = ListItem(List=line_24, Index=closest_point.CPIndex, Wrap=True)
point_in_breps_3 = PointInBreps(Brep=sphere_5, Point=point_21, Strict=False)  # -> Inside, Index
merge_5 = Merge(
    Data1=flatten(load_2),
    Data2=flatten(show_2),
    Data3=flatten(edgelengths_2),
    Data4=flatten(anchor_2),
    Data5=flatten(anchorxyz_2))
quad_remesh_5 = QuadRemesh(Mesh=extrude_20, Settings={aqc=True, as=50, dhe=True, gci=0, null=False, pme=0, sa=0, tqc=2000})
point_in_breps_4 = PointInBreps(Brep=[sphere_4, sphere_6], Point=point_21, Strict=False)  # -> Inside, Index
line_25 = Line(list_item_21)
point_22 = Point(nakedvertices_3.NakedPts)
mesh_edges_2 = MeshEdges(Mesh=quad_remesh_4)  # -> NakedEdges, InteriorEdges, NonManifoldEdges
mesh_edges_3 = MeshEdges(Mesh=quad_remesh_5)  # -> NakedEdges, InteriorEdges, NonManifoldEdges
dispatch_4 = Dispatch(List=point_21, DispatchPattern=point_in_breps_4.Inside)  # -> ListA, ListB
dispatch_5 = Dispatch(List=point_21, DispatchPattern=point_in_breps_3.Inside)  # -> ListA, ListB
pull_point = PullPoint(Point=point_22, Geometry=line_25, ClosestOnly=True)  # -> ClosestPoint, Distance
subd_from_mesh_4 = SubDFromMesh(Mesh=quad_remesh_4, Creases=1, Corners=1, Interpolate=False)
subd_from_mesh_5 = SubDFromMesh(Mesh=quad_remesh_5, Creases=1, Corners=1, Interpolate=False)
bouncysolver_2 = BouncySolver(GoalObjects=merge_5, Reset=Button(), Threshold=1e-15, Tolerance=0.0001, Damping=0.99, Iterations=10, On=Toggle(False))  # -> I, V, O
bouncysolver_3 = BouncySolver(GoalObjects=merge_5, Reset=Button(), Threshold=1e-15, Tolerance=0.0001, Damping=0.99, Iterations=10, On=Toggle(False))  # -> I, V, O
point_23 = Point(dispatch_4.ListB)
point_24 = Point(dispatch_4.ListA)
unit_z_19 = UnitZ(Factor=Slider(6698, range=0..10000))
unit_z_20 = UnitZ(Factor=Slider(44.9, range=0..100))
point_25 = Point(dispatch_5.ListB)
point_26 = Point(dispatch_5.ListA)
smaller_than = SmallerThan(FirstNumber=pull_point.Distance, SecondNumber=Slider(1, range=-0.01..1))  # -> SmallerThan, OrEqualTo
data = Data(bouncysolver_2.O)
load_3 = Load(Point=deconstruct_mesh_3.Vertices, ForceVector=unit_z_20, Weighting=1)
edgelengths_3 = EdgeLengths(Mesh=quad_remesh_3, LengthFactor=Slider(0.4, range=0..1), Strength=1)
anchor_3 = Anchor(Point=point_24, Strength=Slider(5, range=0..1000))
data_2 = Data(bouncysolver_3.O)
show_3 = Show(G=quad_remesh_3)
match_text = MatchText(Text=data, Pattern="Mesh*", Case=True)
anchorxyz_3 = AnchorXYZ(Point=point_23, X=Toggle(False), Y=Toggle(False), Z=Toggle(False), Strength=Slider(113, range=0..1000))
dispatch_6 = Dispatch(List=point_22, DispatchPattern=smaller_than.SmallerThan)  # -> ListA, ListB
match_text_2 = MatchText(Text=data_2, Pattern="Mesh*", Case=True)
cull_pattern = CullPattern(List=data, CullPattern=match_text)
anchor_4 = Anchor(Point=point_26, Strength=Slider(38, range=0..1000))
merge_6 = Merge(
    Data1=flatten(load_3),
    Data2=flatten(show_3),
    Data3=flatten(edgelengths_3),
    Data4=flatten(anchor_3),
    Data5=flatten(anchor_4))
point_27 = Point(dispatch_6.ListA)
cull_pattern_2 = CullPattern(List=data_2, CullPattern=match_text_2)
line_26 = Line(line_25)
weaverbird_s_loop_subdivision = WeaverbirdsLoopSubdivision(MeshCurves=cull_pattern, Level=1, SmoothNakedEdges=1)
length = Length(Curve=line_26)
curve_middle_2 = CurveMiddle(Curve=line_26)
weaverbird_s_loop_subdivision_2 = WeaverbirdsLoopSubdivision(MeshCurves=cull_pattern_2, Level=1, SmoothNakedEdges=1)
bouncysolver_4 = BouncySolver(GoalObjects=merge_6, Reset=Button(), Threshold=1e-15, Tolerance=0.0001, Damping=0.99, Iterations=10, On=Toggle(False))  # -> I, V, O
weaverbird_s_picture_frame = WeaverbirdsPictureFrame(MeshPolylines=cull_pattern, Distance=Slider(12, range=0..100), InsetType=0)
division = Division(A=length, B="2")
weaverbird_s_picture_frame_2 = WeaverbirdsPictureFrame(MeshPolylines=cull_pattern_2, Distance=Slider(12, range=0..100), InsetType=0)
bouncysolver_5 = BouncySolver(GoalObjects=merge_6, Reset=Button(), Threshold=1e-15, Tolerance=0.0001, Damping=0.99, Iterations=10, On=Toggle(False))  # -> I, V, O
data_3 = Data(bouncysolver_4.O)
circle = Circle(Plane=curve_middle_2, Radius=division)
weaverbird_s_mesh_thicken = WeaverbirdsMeshThicken(MeshCurves=weaverbird_s_loop_subdivision, Distance=Slider(881, range=0..10000), OffsetType=0)
weaverbird_s_mesh_thicken_2 = WeaverbirdsMeshThicken(MeshCurves=weaverbird_s_picture_frame, Distance=Slider(10, range=0..10), OffsetType=0)
match_text_3 = MatchText(Text=data_3, Pattern="Mesh*", Case=True)
weaverbird_s_mesh_thicken_3 = WeaverbirdsMeshThicken(MeshCurves=weaverbird_s_loop_subdivision_2, Distance=Slider(881, range=0..10000), OffsetType=0)
curve_curve_2 = CurveCurve(CurveA=line_26, CurveB=circle)  # -> Points, ParamsA, ParamsB
weaverbird_s_mesh_thicken_4 = WeaverbirdsMeshThicken(MeshCurves=weaverbird_s_picture_frame_2, Distance=Slider(10, range=0..10), OffsetType=0)
deconstruct_mesh_4 = DeconstructMesh(Mesh=weaverbird_s_loop_subdivision)  # -> Vertices, Faces, Colours, Normals
data_4 = Data(bouncysolver_5.O)
cull_pattern_3 = CullPattern(List=data_3, CullPattern=match_text_3)
shatter_8 = Shatter(Curve=graft(circle), Parameters=curve_curve_2.ParamsB)  # -> simplify(Segments)
match_text_4 = MatchText(Text=data_4, Pattern="Mesh*", Case=True)
weaverbird_s_loop_subdivision_3 = WeaverbirdsLoopSubdivision(MeshCurves=cull_pattern_3, Level=1, SmoothNakedEdges=1)
deconstruct_face = DeconstructFace(Face=deconstruct_mesh_4.Faces)  # -> CornerA, CornerB, CornerC, CornerD
cull_pattern_4 = CullPattern(List=data_4, CullPattern=match_text_4)
deconstruct_mesh_5 = DeconstructMesh(Mesh=weaverbird_s_loop_subdivision_2)  # -> Vertices, Faces, Colours, Normals
point_on_curve_4 = PointOnCurve(shatter_8, parameter=0.049)
weaverbird_s_picture_frame_3 = WeaverbirdsPictureFrame(MeshPolylines=cull_pattern_3, Distance=Slider(12, range=0..100), InsetType=0)
brep_closest_point = BrepClosestPoint(Point=point_on_curve_4, Brep=surface_4)  # -> Point, Normal, Distance
weaverbird_s_loop_subdivision_4 = WeaverbirdsLoopSubdivision(MeshCurves=cull_pattern_4, Level=1, SmoothNakedEdges=1)
list_item_22 = ListItem(List=deconstruct_mesh_4.Vertices, Index=deconstruct_face.CornerA, Wrap=True)
list_item_23 = ListItem(List=deconstruct_mesh_4.Vertices, Index=deconstruct_face.CornerD, Wrap=True)
list_item_24 = ListItem(List=deconstruct_mesh_4.Vertices, Index=deconstruct_face.CornerC, Wrap=True)
list_item_25 = ListItem(List=deconstruct_mesh_4.Vertices, Index=deconstruct_face.CornerB, Wrap=True)
deconstruct_mesh_6 = DeconstructMesh(Mesh=weaverbird_s_loop_subdivision_3)  # -> Vertices, Faces, Colours, Normals
deconstruct_face_2 = DeconstructFace(Face=deconstruct_mesh_5.Faces)  # -> CornerA, CornerB, CornerC, CornerD
sort_list = SortList(Keys=brep_closest_point.Distance, ValuesValuesA=shatter_8)  # -> Keys, ValuesValuesA
weaverbird_s_mesh_thicken_5 = WeaverbirdsMeshThicken(MeshCurves=weaverbird_s_loop_subdivision_3, Distance=Slider(881, range=0..10000), OffsetType=0)
_4point_surface = _4PointSurface(CornerA=list_item_22, CornerB=list_item_25, CornerC=list_item_24, CornerD=list_item_23)  # -> reparameterize(Surface)
weaverbird_s_mesh_thicken_6 = WeaverbirdsMeshThicken(MeshCurves=weaverbird_s_picture_frame_3, Distance=Slider(10, range=0..10), OffsetType=0)
list_length_3 = ListLength(List=point_27)
list_item_26 = ListItem(List=sort_list.ValuesValuesA, Index="1", Wrap=True)
subtraction = Subtraction(A=list_length_3, B="1")
deconstruct_mesh_7 = DeconstructMesh(Mesh=weaverbird_s_loop_subdivision_4)  # -> Vertices, Faces, Colours, Normals
list_item_27 = ListItem(List=deconstruct_mesh_5.Vertices, Index=deconstruct_face_2.CornerA, Wrap=True)
list_item_28 = ListItem(List=deconstruct_mesh_5.Vertices, Index=deconstruct_face_2.CornerD, Wrap=True)
list_item_29 = ListItem(List=deconstruct_mesh_5.Vertices, Index=deconstruct_face_2.CornerC, Wrap=True)
list_item_30 = ListItem(List=deconstruct_mesh_5.Vertices, Index=deconstruct_face_2.CornerB, Wrap=True)
deconstruct_face_3 = DeconstructFace(Face=deconstruct_mesh_6.Faces)  # -> CornerA, CornerB, CornerC, CornerD
brep_join = BrepJoin(Breps=_4point_surface)  # -> Breps, Closed
curve_33 = Curve(list_item_26)
weaverbird_s_loop_subdivision_5 = WeaverbirdsLoopSubdivision(MeshCurves=weaverbird_s_mesh_thicken_6, Level=Slider(2, range=0..10), SmoothNakedEdges=1)
line_27 = Line(line_26)
_4point_surface_2 = _4PointSurface(CornerA=list_item_27, CornerB=list_item_30, CornerC=list_item_29, CornerD=list_item_28)  # -> reparameterize(Surface)
list_item_31 = ListItem(List=brep_join.Breps, Index=0, Wrap=True)
end_points_17 = EndPoints(Curve=curve_33)  # -> Start, End
end_points_18 = EndPoints(Curve=line_27)  # -> Start, End
divide_curve_7 = DivideCurve(Curve=curve_33, Count=subtraction, Kinks=False)  # -> Points, Tangents, Parameters
deconstruct_face_4 = DeconstructFace(Face=deconstruct_mesh_7.Faces)  # -> CornerA, CornerB, CornerC, CornerD
list_item_32 = ListItem(List=deconstruct_mesh_6.Vertices, Index=deconstruct_face_3.CornerA, Wrap=True)
list_item_33 = ListItem(List=deconstruct_mesh_6.Vertices, Index=deconstruct_face_3.CornerD, Wrap=True)
list_item_34 = ListItem(List=deconstruct_mesh_6.Vertices, Index=deconstruct_face_3.CornerC, Wrap=True)
list_item_35 = ListItem(List=deconstruct_mesh_6.Vertices, Index=deconstruct_face_3.CornerB, Wrap=True)
distance = Distance(PointA=end_points_17.Start, PointB=end_points_18.Start)
brep = Brep([<brep referenced from the Rhino model> x22])
_4point_surface_3 = _4PointSurface(CornerA=list_item_32, CornerB=list_item_35, CornerC=list_item_34, CornerD=list_item_33)  # -> reparameterize(Surface)
brep_join_2 = BrepJoin(Breps=_4point_surface_2)  # -> Breps, Closed
split_brep_multiple = SplitBrepMultiple(Brep=list_item_31, Cutters=flatten(brep))
equality_2 = Equality(FirstNumber=distance, SecondNumber="0")  # -> Equality, Inequality
list_item_36 = ListItem(List=deconstruct_mesh_7.Vertices, Index=deconstruct_face_4.CornerA, Wrap=True)
list_item_37 = ListItem(List=deconstruct_mesh_7.Vertices, Index=deconstruct_face_4.CornerD, Wrap=True)
list_item_38 = ListItem(List=deconstruct_mesh_7.Vertices, Index=deconstruct_face_4.CornerC, Wrap=True)
list_item_39 = ListItem(List=deconstruct_mesh_7.Vertices, Index=deconstruct_face_4.CornerB, Wrap=True)
brep_join_3 = BrepJoin(Breps=_4point_surface_3)  # -> Breps, Closed
brep_edges = BrepEdges(Brep=brep_join_2.Breps)  # -> Naked, Interior, NonManifold
_4point_surface_4 = _4PointSurface(CornerA=list_item_36, CornerB=list_item_39, CornerC=list_item_38, CornerD=list_item_37)  # -> reparameterize(Surface)
point_28 = Point(<point referenced from the Rhino model>)
unit_z_21 = UnitZ(Factor=Slider(522, range=0..1000))
dispatch_7 = Dispatch(List=line_27, DispatchPattern=equality_2.Equality)  # -> ListA, ListB
list_item_40 = ListItem(List=split_brep_multiple, Index=Slider(0, range=0..10), Wrap=True)
panel_7 = Panel(equality_2.Equality)
brep_closest_point_2 = BrepClosestPoint(Point=point_28, Brep=brep_join_3.Breps)  # -> Point, Normal, Distance
rebuild_curve_2 = RebuildCurve(Curve=[brep_edges.Interior, brep_edges.Naked], Count=10, Tangents=False)
extrude_21 = Extrude(Base=list_item_40, Direction=unit_z_21)
curve_34 = Curve(<curve referenced from the Rhino model>)
curve_35 = Curve(<curve referenced from the Rhino model>)
brep_join_4 = BrepJoin(Breps=_4point_surface_4)  # -> Breps, Closed
flip_curve = FlipCurve(Curve=dispatch_7.ListB)  # -> Curve, Flag
curve_36 = Curve(<curve referenced from the Rhino model>)
curve_37 = Curve(<curve referenced from the Rhino model>)
curve_38 = Curve(<curve referenced from the Rhino model>)
curve_39 = Curve(<curve referenced from the Rhino model>)
curve_40 = Curve(<curve referenced from the Rhino model>)
curve_41 = Curve(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)
curve_42 = Curve(<curve referenced from the Rhino model>)
curve_43 = Curve(<curve referenced from the Rhino model>)
curve_44 = Curve(<curve referenced from the Rhino model>)
curve_45 = Curve(<curve referenced from the Rhino model>)
curve_46 = Curve(<curve referenced from the Rhino model>)
curve_47 = Curve(<curve referenced from the Rhino model>)
curve_48 = Curve(<curve referenced from the Rhino model>)
unit_z_22 = UnitZ(Factor=Slider(16135, range=0..20000))
boundary_surfaces_15 = BoundarySurfaces(Edges=[curve_35, curve_34])
unit_z_23 = UnitZ(Factor=Slider(5943, range=0..20000))
pipe = Pipe(Curve=rebuild_curve_2, Radius=Slider(30, range=0..100), Caps=0)
merge_7 = Merge(Data1=dispatch_7.ListA, Data2=flip_curve.Curve)
unit_z_24 = UnitZ(Factor=Slider(2233, range=0..20000))
brep_edges_2 = BrepEdges(Brep=brep_join_4.Breps)  # -> Naked, Interior, NonManifold
curve_49 = Curve(<curve referenced from the Rhino model>)
curve_50 = Curve(<curve referenced from the Rhino model>)
list_item_41 = ListItem(List=brep_join_3.Breps, Index=0, Wrap=True)
project = Project(Curve=curve_36, Brep=list_item_41, Direction=Vector(0, 0, 1))  # -> flatten(Curve)
project_2 = Project(Curve=curve_37, Brep=list_item_41, Direction=Vector(0, 0, 1))  # -> flatten(Curve)
curve_51 = Curve(merge_7)
unit_z_25 = UnitZ(Factor=Slider(1490, range=0..20000))
extrude_22 = Extrude(Base=curve_46, Direction=unit_z_23)
extrude_23 = Extrude(Base=curve_49, Direction=unit_z_24)
extrude_24 = Extrude(
    Base=[curve_39, curve_41, curve_43, curve_45, curve_48, curve_38, boundary_surfaces_15, curve_46, curve_40, curve_42, curve_44, curve_47],
    Direction=unit_z_22)
rebuild_curve_3 = RebuildCurve(Curve=[brep_edges_2.Interior, brep_edges_2.Naked], Count=10, Tangents=False)
sort_along_curve = SortAlongCurve(Points=point_27, Curve=curve_51)  # -> Points, Indices
end_points_19 = EndPoints(Curve=project)  # -> Start, End
extrude_25 = Extrude(Base=curve_50, Direction=unit_z_25)
end_points_20 = EndPoints(Curve=project_2)  # -> Start, End
cap_holes = CapHoles(Brep=extrude_22)
cap_holes_2 = CapHoles(Brep=extrude_24)
cap_holes_3 = CapHoles(Brep=extrude_23)
pipe_2 = Pipe(Curve=rebuild_curve_3, Radius=Slider(30, range=0..100), Caps=0)
point_29 = Point(divide_curve_7.Points)
point_30 = Point(sort_along_curve.Points)
cap_holes_4 = CapHoles(Brep=extrude_25)
line_28 = Line(StartPoint=end_points_19.Start, EndPoint=end_points_20.End)
line_29 = Line(StartPoint=end_points_20.Start, EndPoint=end_points_19.End)
split_brep = SplitBrep(Brep=cap_holes_2, Cutter=graft(brep_join_3.Breps))
line_30 = Line(StartPoint=point_29, EndPoint=point_30)
mesh_6 = Mesh(mesh_4)
join_curves_4 = JoinCurves(Curves=[project, line_29, project_2, line_28], Preserve=False)
xy_plane_4 = XYPlane(Origin=Point(0, 0, 0))
list_item_42 = ListItem(List=split_brep, Index="3", Wrap=True)
brep_2 = Brep([<brep referenced from the Rhino model> x15])
negative_2 = Negative(Value=Slider(3000, range=0..3000))
curve_52 = Curve(<curve referenced from the Rhino model>)
deconstruct_mesh_8 = DeconstructMesh(Mesh=mesh_6)  # -> Vertices, Faces, Colours, Normals
curve_53 = Curve(<curve referenced from the Rhino model>)
split_brep_multiple_2 = SplitBrepMultiple(Brep=list_item_41, Cutters=flatten(brep_2))
unit_z_26 = UnitZ(Factor=Slider(14211, range=0..40000))
project_3 = Project(Geometry=join_curves_4, Plane=xy_plane_4)  # -> Geometry, Transform
unit_z_27 = UnitZ(Factor=negative_2)
divide_curve_8 = DivideCurve(Curve=curve_52, Count=Slider(2, range=0..10), Kinks=False)  # -> Points, Tangents, Parameters
unit_z_28 = UnitZ(Factor=Slider(0.2, range=0..1))
curve_54 = Curve(<curve referenced from the Rhino model>)
divide_curve_9 = DivideCurve(Curve=curve_53, Count=Slider(4, range=0..10), Kinks=False)  # -> Points, Tangents, Parameters
unit_z_29 = UnitZ(Factor=Slider(522, range=0..1000))
list_item_43 = ListItem(List=split_brep_multiple_2, Index=Slider(0, range=0..10), Wrap=True)
edgelengths_4 = EdgeLengths(Mesh=mesh_6, LengthFactor=Slider(0.01, range=0..0.01), Strength=1)
curve_55 = Curve(<curve referenced from the Rhino model>)
extrude_26 = Extrude(Base=graft([project, project_2]), Direction=[unit_z_27, unit_z_26])
curve_closest_point_11 = CurveClosestPoint(Point=divide_curve_8.Points, Curve=curve_54)  # -> Point, Parameter, Distance
show_4 = Show(G=mesh_6)
anchor_5 = Anchor(Point=point_29, Target=point_30, Strength=Slider(783, range=0..1000))
load_4 = Load(Point=deconstruct_mesh_8.Vertices, ForceVector=unit_z_28, Weighting=1)
offset_curve_4 = OffsetCurve(Curve=project_3.Geometry, Distance=Slider(3000, range=0..10000), Corners=1)
curve_closest_point_12 = CurveClosestPoint(Point=divide_curve_9.Points, Curve=curve_55)  # -> Point, Parameter, Distance
extrude_27 = Extrude(Base=list_item_43, Direction=unit_z_29)
line_31 = Line(StartPoint=divide_curve_8.Points, EndPoint=curve_closest_point_11.Point)
split_brep_multiple_3 = SplitBrepMultiple(Brep=list_item_41, Cutters=flatten(extrude_26))
negative_3 = Negative(Value=Slider(300, range=0..1000))
line_32 = Line(StartPoint=divide_curve_9.Points, EndPoint=curve_closest_point_12.Point)
merge_8 = Merge(Data1=show_4, Data2=edgelengths_4, Data3=load_4, Data4=flatten(anchor_5))
end_points_21 = EndPoints(Curve=line_31)  # -> Start, End
offset_curve_loose = OffsetCurveLoose(Curve=line_31, Distance=negative_3)
list_item_44 = ListItem(List=split_brep_multiple_3, Index="1", Wrap=True)
offset_curve_loose_2 = OffsetCurveLoose(Curve=line_32, Distance=negative_3)
end_points_22 = EndPoints(Curve=line_32)  # -> Start, End
end_points_23 = EndPoints(Curve=offset_curve_loose)  # -> Start, End
bouncysolver_6 = BouncySolver(
    GoalObjects=flatten(merge_8),
    Reset=Button(),
    Threshold=1e-15,
    Tolerance=0.0001,
    Damping=0.99,
    Iterations=10,
    On=Toggle(True))  # -> I, V, O
populate_geometry = PopulateGeometry(Geometry=list_item_44, Count=Slider(15, range=0..100), Seed=4)
end_points_24 = EndPoints(Curve=offset_curve_loose_2)  # -> Start, End
line_33 = Line(StartPoint=end_points_21.Start, EndPoint=end_points_23.Start)
line_34 = Line(StartPoint=end_points_21.End, EndPoint=end_points_23.End)
line_35 = Line(StartPoint=end_points_24.End, EndPoint=end_points_22.End)
line_36 = Line(StartPoint=end_points_24.Start, EndPoint=end_points_22.Start)
voronoi = Voronoi(Points=populate_geometry, Boundary=offset_curve_4, BruteForceOverride=False)
join_curves_5 = JoinCurves(Curves=[line_34, line_31, line_33, offset_curve_loose], Preserve=False)
join_curves_6 = JoinCurves(Curves=[offset_curve_loose_2, line_36, line_35, line_32], Preserve=False)
unit_z_30 = UnitZ(Factor=Slider(5309, range=0..10000))
area_3 = Area(Geometry=voronoi)  # -> Area, Centroid
boundary_surfaces_16 = BoundarySurfaces(Edges=[join_curves_5, join_curves_6])
extrude_28 = Extrude(Base=boundary_surfaces_16, Direction=unit_z_30)
scale = Scale(Geometry=voronoi, Center=area_3.Centroid, Factor=Slider(0.7, range=0..1))  # -> Geometry, Transform
rebuild_curve_4 = RebuildCurve(Curve=scale.Geometry, Degree=Slider(5, range=0..10), Count=Slider(3, range=0..10), Tangents=False)
project_4 = Project(Curve=rebuild_curve_4, Brep=list_item_41, Direction=Vector(0, 0, 1))
closed = Closed(Curve=project_4)  # -> Closed, Periodic
negative_4 = Negative(Value=Slider(3000, range=0..3000))
dispatch_8 = Dispatch(List=project_4, DispatchPattern=closed.Closed)  # -> ListA, ListB
unit_z_31 = UnitZ(Factor=negative_4)
unit_z_32 = UnitZ(Factor=Slider(3000, range=0..3000))
curve_56 = Curve(dispatch_8.ListA)
extrude_29 = Extrude(Base=curve_56, Direction=[unit_z_31, unit_z_32])
