# Grasshopper definition spiral retractable.gh (Grasshopper 1.0.8)

degrees = Slider(104, range=0..360)
degrees_2 = Slider(0, range=0..360)
factor = Slider(7, range=0..20)
steps = Slider(199, range=0..400)
point = Point(<point referenced from the Rhino model>)
domain_end = Slider(12, range=0..100)
domain_start = Slider(0, range=0..100)
offset = Slider(4.5, range=0..10)
pi = Pi(Factor=factor)
point_2 = Point(<point referenced from the Rhino model>)
radians = Radians(Degrees=degrees)
radians_2 = Radians(Degrees=degrees_2)
construct_domain = ConstructDomain(DomainStart=domain_start, DomainEnd=domain_end)
domain_end_2 = Slider(18, range=0..100)
domain_start_2 = Slider(0, range=0..100)
range = Range(Domain=pi, Steps=steps)
point_polar = PointPolar(BasePlane=point_2, XYAngle=radians, ZAngle=radians_2, Offset=offset)
range_2 = Range(Domain=construct_domain, Steps=steps)
panel = Panel(range)
circle = Circle(Plane=point_2, Radius=offset)
construct_domain_2 = ConstructDomain(DomainStart=domain_start_2, DomainEnd=domain_end_2)
line = Line(StartPoint=point_2, EndPoint=point_polar)
range_3 = Range(Domain=construct_domain_2, Steps=steps)
point_polar_2 = PointPolar(BasePlane=point, XYAngle=range, ZAngle=0, Offset=range_2)
unit_z = UnitZ(Factor=range_3)
move = Move(Geometry=point_polar_2, Motion=unit_z)  # -> Geometry, Transform
interpolate = Interpolate(Vertices=move.Geometry, Degree=3, Periodic=False, KnotStyle=1)  # -> Curve, Length, Domain
curve_closest_point = CurveClosestPoint(Point=move.Geometry, Curve=interpolate.Curve)  # -> Point, Parameter, Distance
number_slider = Slider(2022, range=0..5000)
horizontal_frame = HorizontalFrame(Curve=interpolate.Curve, Parameter=curve_closest_point.Parameter)
x_coordinate = Slider(1174.76, range=0..10000)
division = Division(A=number_slider, B=Slider(20, range=0..100))
deconstruct_plane = DeconstructPlane(Plane=horizontal_frame)  # -> Origin, XAxis, YAxis, ZAxis
construct_domain_3 = ConstructDomain(DomainStart=Slider(0, range=0..1000), DomainEnd=number_slider)
length = Slider(3.94, range=0..10)
construct_point = ConstructPoint(XCoordinate=x_coordinate, YCoordinate=0, ZCoordinate=0)
reverse = Reverse(Vector=deconstruct_plane.YAxis)
range_4 = Range(Domain=construct_domain_3, Steps=division)
xy_plane = XYPlane(Origin=Point(0, 0, 0))
line_sdl = LineSDL(Start=deconstruct_plane.Origin, Direction=reverse, Length=length)
rotate = Rotate(Geometry=construct_point, Angle=range_4, Plane=xy_plane)  # -> Geometry, Transform
panel_2 = Panel(range_4)
loft = Loft(Curves=line_sdl, Options={Adjust=False, Closed=False, LoftEnds=0, LoftSimp=0, LoftType=0, Rebuild=10, Refit=0.01})
interpolate_2 = Interpolate(Vertices=rotate.Geometry, Degree=3, Periodic=False, KnotStyle=1)  # -> Curve, Length, Domain
repeat_data = RepeatData(Data="300", Length="10")
merge = Merge(Data1=flatten(repeat_data), Data2=flatten("1000"))
length_2 = Length(Curve=interpolate_2.Curve)
mass_addition = MassAddition(Input=merge)  # -> Result, PartialResults
group = Group(Objects=loft)
division_2 = Division(A=mass_addition.PartialResults, B=length_2)
shatter = Shatter(Curve=reparameterize(interpolate_2.Curve), Parameters=division_2)
cull_index = CullIndex(List=shatter, Indices="-1", Wrap=True)
scale = Scale(Geometry=cull_index, Center=Point(0, 0, 0), Factor=Slider(4, range=1..10))  # -> Geometry, Transform
ruled_surface = RuledSurface(CurveA=cull_index, CurveB=scale.Geometry)
list_length = ListLength(List=ruled_surface)
series = Series(Start="150", Step="150", Count=list_length)
unit_z_2 = UnitZ(Factor=series)
move_2 = Move(Geometry=cull_index, Motion=unit_z_2)  # -> Geometry, Transform
curve = Curve(move_2.Geometry)
move_3 = Move(Geometry=ruled_surface, Motion=unit_z_2)  # -> Geometry, Transform
tread_height = Slider(200, range=0..1000)
horizontal_frame_2 = HorizontalFrame(Curve=reparameterize(curve), Parameter="0.5")
xy_plane_2 = XYPlane(Origin=Point(0, 0, 0))
dispatch = Dispatch(List=horizontal_frame_2, DispatchPattern="0")  # -> ListA, ListB
surface_box = SurfaceBox(Surface=move_3.Geometry, Domain=move_3.Geometry, Height=tread_height)
bounding_box = BoundingBox(Content=group, Plane=PlaneXY(0, 0, 0))  # -> Box, Box_2
orient = Orient(Geometry=group, Source=xy_plane_2, Target=dispatch.ListB)  # -> Geometry, Transform
box_morph = BoxMorph(Geometry=group, Reference=bounding_box.Box, Target=surface_box)
