# Grasshopper definition spiral stairs.gh (Grasshopper 1.0.8)

number_slider = Slider(1000, range=0..2000)
number_slider_2 = Slider(2000, range=0..2000)
number_slider_3 = Slider(410, range=0..1000)
pt = ConstructPoint(XCoordinate=0, YCoordinate=0, ZCoordinate=0)
pt_2 = ConstructPoint(XCoordinate=number_slider, YCoordinate=0, ZCoordinate=0)
addition = Addition(A=number_slider, B=number_slider_2)
division = Division(A=number_slider_3, B=Slider(12, range=0..100))
dom = ConstructDomain(DomainStart=Slider(0, range=0..10), DomainEnd=number_slider_3)
circle = CircleCNR(Center=pt, Normal=Vector(0, 0, 1), Radius=number_slider)
pt_3 = ConstructPoint(XCoordinate=Slider(1000, range=0..2000), YCoordinate=0, ZCoordinate=0)
repeat = RepeatData(Data="300", Length="10")
X = UnitX(Factor=1)
circle_2 = CircleCNR(Center=pt, Normal=Vector(0, 0, 1), Radius=addition)
range = Range(Domain=dom, Steps=division)
xy = XYPlane(Origin=Point(0, 0, 0))
merge = Merge(Data1=flatten(repeat), Data2=flatten("1000"))
panel = Panel(range)
Z = UnitZ(Factor=1)
line = LineSDL(Start=pt_2, Direction=X, Length=number_slider_2)
pt_4 = ConstructPoint(XCoordinate=0, YCoordinate=0, ZCoordinate=0)
rotate = Rotate(Geometry=pt_3, Angle=range, Plane=xy)  # -> Geometry, Transform
ma = MassAddition(Input=merge)  # -> Result, PartialResults
line_2 = LineSDL(Start=pt_4, Direction=Z, Length=1)
rad = Radians(Degrees=Slider(219.188, range=0..360))
rad_2 = Radians(Degrees=Slider(191.343, range=0..360))
intcrv = Interpolate(Vertices=rotate.Geometry, Degree=3, Periodic=False, KnotStyle=1)  # -> Curve, Length, Domain
len = Length(Curve=intcrv.Curve)
division_2 = Division(A=ma.PartialResults, B=len)
dom_2 = ConstructDomain(DomainStart=rad_2, DomainEnd=rad)
revsrf = Revolution(Curve=line, Axis=line_2, Domain=dom_2)
panel_2 = Panel(division_2)
shatter = Shatter(Curve=reparameterize(intcrv.Curve), Parameters=division_2)
cull_i = CullIndex(List=shatter, Indices="-1", Wrap=True)
scale = Scale(Geometry=cull_i, Center=Point(0, 0, 0), Factor=Slider(3, range=0..10))  # -> Geometry, Transform
rulesrf = RuledSurface(CurveA=cull_i, CurveB=scale.Geometry)
lng = ListLength(List=rulesrf)
series = Series(Start="150", Step="150", Count=lng)
Z_2 = UnitZ(Factor=series)
move = Move(Geometry=rulesrf, Motion=Z_2)  # -> Geometry, Transform
panel_3 = Panel(series)
sbox = SurfaceBox(Surface=move.Geometry, Domain=move.Geometry, Height=Slider(-246.373, range=-2000..0.001))
crv = Curve(move.Geometry)
geo = Geometry(<extrusion referenced from the Rhino model>)
geo_2 = Geometry(<extrusion referenced from the Rhino model>)
hframe = HorizontalFrame(Curve=reparameterize(crv), Parameter="0.5")
group = Group(Objects=[geo_2, geo])
xy_2 = XYPlane(Origin=Point(0, 0, 0))
dispatch = Dispatch(List=hframe, DispatchPattern="0")  # -> ListA, ListB
panel_4 = Panel(group)
orient = Orient(Geometry=group, Source=xy_2, Target=dispatch.ListB)  # -> Geometry, Transform
bbox = BoundingBox(Content=group, Plane=PlaneXY(0, 0, 0))  # -> Box, Box_2
morph = BoxMorph(Geometry=group, Reference=bbox.Box, Target=sbox)
