# Grasshopper definition stairs and truss.gh (Grasshopper 1.0.8)
# plug-ins: RhinoCodePluginGH

number_slider = Slider(8, range=0..10)
crv = Curve(<curve referenced from the Rhino model>)
crv_2 = Curve(<curve referenced from the Rhino model>)
panel = Panel("""0
1""")
divide = DivideCurve(Curve=crv, Count=number_slider, Kinks=False)  # -> Points, Tangents, Parameters
divide_2 = DivideCurve(Curve=crv_2, Count=number_slider, Kinks=False)  # -> Points, Tangents, Parameters
dom = ConstructDomain(DomainStart=Slider(0, range=0..1), DomainEnd=Slider(10, range=0..10))
range = Range(Domain=dom, Steps=expr("x-1", "40"))
series = Series(Start="5", Step="5", Count="40")
dispatch = Dispatch(List=divide_2.Points, DispatchPattern=panel)  # -> ListA, ListB
dispatch_2 = Dispatch(List=divide.Points, DispatchPattern=panel)  # -> ListA, ListB
short = ShortestList(ListA=series, ListB=range, TrimMode=2)  # -> ListA, ListB
item = ListItem(List=range, Index="0", Wrap=True)  # -> Item, Item1
panel_2 = Panel(series)
ipy2 = IronPython2Script(topFlange=crv, bottomFlange=crv_2)  # -> out, trussWebs; inputs topFlange: Curve, bottomFlange: Curve
# ---------- ipy2: IronPython ----------
import ghpythonlib.components as ghc
#Point A
trussDivision = 10

#Point B
topPoints = ghc.DivideCurve(topFlange, trussDivision, False)
bottomPoints = ghc.DivideCurve(bottomFlange, trussDivision, False)

#Point C
topPoints = ghc.Dispatch(topPoints["points"],[False, True])
bottomPoints = ghc.Dispatch(bottomPoints["points"],[False,True])
print(topPoints)

#Point D
trussPoints = ghc.Weave([1,0],topPoints["list_a"],bottomPoints["list_b"])
print(trussPoints)

trussWebs = ghc.PolyLine(trussPoints, False)
# ---------- end ipy2 ----------
pt = Point(dispatch_2.ListA)
pt_2 = Point(dispatch.ListB)
ln = Line(StartPoint=divide.Points, EndPoint=divide_2.Points)
subtraction = Subtraction(A=item.Item1, B=item.Item)
pt_3 = ConstructPoint(XCoordinate=short.ListA, YCoordinate=short.ListB, ZCoordinate=0)
unit_y = UnitY(Factor=subtraction)
weave = Weave(Pattern=panel, Stream0=pt_2, Stream1=pt, NullGaps=False)
panel_3 = Panel("""0
1""")
panel_4 = Panel(subtraction)
move = Move(Geometry=pt_3, Motion=unit_y)  # -> Geometry, Transform
crv_3 = Curve(ipy2.trussWebs)
panel_5 = Panel(ipy2.trussWebs)
pline = PolyLine(Vertices=weave, Closed=False)
panel_6 = Panel(unit_y)
weave_2 = Weave(Pattern=panel_3, Stream0=pt_3, Stream1=move.Geometry, NullGaps=False)
panel_7 = Panel("""-1
-2""")
curve = Curve(<curve referenced from the Rhino model>)
cull_i = CullIndex(List=weave_2, Indices=panel_7, Wrap=True)
points = PointList(Points=weave_2, Size=Slider(1, range=0..1))
order = PointOrder(Points=weave_2)
explode = Explode(Curve=curve, Recursive=True)  # -> Segments, Vertices
bounding_box = BoundingBox(Content=cull_i, Plane=PlaneXY(0, 0, 0), UnionBox=True)  # -> Box, Box_2
pline_2 = PolyLine(Vertices=cull_i, Closed=False)
deconstruct_box = DeconstructBox(Box=bounding_box.Box)  # -> Plane, X, Y, Z
surface = Surface(<surface referenced from the Rhino model>)
plane_surface = PlaneSurface(Plane=deconstruct_box.Plane, XSize=deconstruct_box.X, YSize=deconstruct_box.Y)
panel_8 = Panel(bounding_box.Box)
surface_closest_point = SurfaceClosestPoint(Point=cull_i, Surface=reparameterize(plane_surface))  # -> Point, UVPoint, Distance
unit_z = UnitZ(Factor=Slider(4, range=0..100))
panel_9 = Panel(surface_closest_point.UVPoint)
md_slider = MDSlider(
    SliderMode=0,
    slider_value=Point(0.4579036061, 0.5040160388, 0.5),
    x_domain=Domain(0, 1),
    y_domain=Domain(0, 1),
    z_domain=Domain(0, 1))
curve_2 = Curve(<curve referenced from the Rhino model>)
curve_3 = Curve(<curve referenced from the Rhino model>)
extrude = Extrude(Base=curve_3, Direction=unit_z)
extrude_2 = Extrude(Base=curve_2, Direction=unit_z)
panel_10 = Panel(md_slider)
evaluate_surface = EvaluateSurface(Surface=reparameterize(extrude), Point=surface_closest_point.UVPoint)  # -> Point, Normal, UDirection, VDirection, Frame
evaluate_surface_2 = EvaluateSurface(Surface=reparameterize(extrude_2), Point=surface_closest_point.UVPoint)  # -> Point, Normal, UDirection, VDirection, Frame
polyline = PolyLine(Vertices=evaluate_surface.Point, Closed=False)
polyline_2 = PolyLine(Vertices=evaluate_surface_2.Point, Closed=False)
pull_curve = PullCurve(Curve=polyline, Surface=extrude)
loft = Loft(
    Curves=[polyline_2, polyline],
    Options={Adjust=False, Closed=False, LoftEnds=0, LoftSimp=0, LoftType=0, Rebuild=10, Refit=0.01})
