# Grasshopper definition stairs v1.gh (Grasshopper 1.0.8)

number_slider = Slider(59, range=0..100)
pt = ConstructPoint(XCoordinate=0, YCoordinate=0, ZCoordinate=0)
pi = Pi(Factor=Slider(2, range=0..100))
dom = ConstructDomain(DomainStart=Slider(832, range=0..3000), DomainEnd=Slider(1785, range=0..6000))
range = Range(Domain=pi, Steps=number_slider)
dom_2 = ConstructDomain(DomainStart=Slider(0, range=0..100), DomainEnd=Slider(6000, range=0..10000))
range_2 = Range(Domain=dom, Steps=number_slider)
panel = Panel(range)
range_3 = Range(Domain=dom_2, Steps=number_slider)
pt_2 = PointPolar(BasePlane=pt, XYAngle=range, ZAngle=0, Offset=range_2)
Z = UnitZ(Factor=range_3)
move = Move(Geometry=pt_2, Motion=Z)  # -> Geometry, Transform
number_slider_2 = Slider(26, range=0..100)
stairs_width = Slider(1800, range=0..3000)
X = UnitX(Factor=1)
intcrv = Interpolate(Vertices=move.Geometry, Degree=3, Periodic=False, KnotStyle=1)  # -> Curve, Length, Domain
railing_height = Slider(900, range=0..10000)
division = Division(A="360", B=number_slider_2)
addition = Addition(A=number_slider_2)
offset = OffsetCurve(Curve=intcrv.Curve, Distance=stairs_width, Plane=X, Corners=1)
division_2 = Division(A=stairs_width, B="2")
end = EndPoints(Curve=intcrv.Curve)  # -> Start, End
neg = Negative(Value=division_2)
railing_thickness = Slider(600, range=0..1000)
end_2 = EndPoints(Curve=offset)  # -> Start, End
series = Series(Start=0, Step=division, Count=number_slider_2)
Z_2 = UnitZ(Factor=railing_height)
series_2 = Series(Start=0, Step=division, Count=addition)
addition_2 = Addition(A=end.Start, B=end_2.Start)
Z_3 = UnitZ(Factor=neg)
ln = Line(StartPoint=end.Start, EndPoint=end_2.Start)
division_3 = Division(A=addition_2, B="2")
extr = Extrude(Base=offset, Direction=Z_2)
extr_2 = Extrude(Base=intcrv.Curve, Direction=Z_2)
xy = XYPlane(Origin=Point(0, 0, 0))
move_2 = Move(Geometry=division_3, Motion=Z_3)  # -> Geometry, Transform
neg_2 = Negative(Value=railing_thickness)
rotate = Rotate(Geometry=ln, Angle=1.570796327, Plane=xy)  # -> Geometry, Transform
arc = Arc3Pt(PointA=end.Start, PointB=move_2.Geometry, PointC=end_2.Start)  # -> Arc, Plane, Radius
srfsplit = SurfaceSplit()
offset_2 = OffsetSurface(Surface=extr_2, Distance=railing_thickness, Retrim=True)
swp2 = Sweep2(Rail1=offset, Rail2=intcrv.Curve, Sections=arc.Arc, SameHeight=False)
offset_3 = OffsetSurface(Surface=extr, Distance=neg_2, Retrim=True)
offset_4 = OffsetSurface(Surface=swp2, Distance=neg_2, Retrim=True)
division_4 = Division(A=railing_thickness, B="2")
item = ListItem(List=srfsplit, Index=0, Wrap=True)
end_3 = EndPoints(Curve=offset_2)  # -> Start, End
end_4 = EndPoints(Curve=offset_3)  # -> Start, End
addition_3 = Addition(A=end.Start, B=end_3.Start)
addition_4 = Addition(A=end_2.Start, B=end_4.Start)
Z_4 = UnitZ(Factor=division_4)
division_5 = Division(A=addition_3, B="2")
division_6 = Division(A=addition_4, B="2")
Z_5 = UnitZ(Factor=railing_height)
move_3 = Move(Geometry=division_5, Motion=Z_4)  # -> Geometry, Transform
move_4 = Move(Geometry=division_6, Motion=Z_4)  # -> Geometry, Transform
arc_2 = Arc3Pt(PointA=end.Start, PointB=move_3.Geometry, PointC=end_3.Start)  # -> Arc, Plane, Radius
Z_6 = UnitZ(Factor=railing_height)
arc_3 = Arc3Pt(PointA=end_2.Start, PointB=move_4.Geometry, PointC=end_4.End)  # -> Arc, Plane, Radius
Z_7 = UnitZ(Factor=railing_height)
move_5 = Move(Geometry=arc_2.Arc, Motion=Z_5)  # -> Geometry, Transform
move_6 = Move(Geometry=intcrv.Curve, Motion=Z_6)  # -> Geometry, Transform
move_7 = Move(Geometry=arc_3.Arc, Motion=Z_5)  # -> Geometry, Transform
move_8 = Move(Geometry=offset, Motion=Z_7)  # -> Geometry, Transform
X_2 = UnitX(Factor=1)
X_3 = UnitX(Factor=1)
offset_5 = OffsetCurve(Curve=move_8.Geometry, Distance=railing_thickness, Plane=X_2, Corners=1)
offset_6 = OffsetCurve(Curve=move_6.Geometry, Distance=neg_2, Plane=X_3, Corners=1)
swp2_2 = Sweep2(Rail1=offset_5, Rail2=move_8.Geometry, Sections=move_7.Geometry, SameHeight=False)
swp2_3 = Sweep2(Rail1=offset_6, Rail2=move_6.Geometry, Sections=move_5.Geometry, SameHeight=False)
