# Grasshopper definition star.gh (Grasshopper 1.0.8)

triangular = Triangular(Plane=PlaneXY(0, 0, 0), Size=1, ExtentX=Slider(20, range=0..20), ExtentY=Slider(20, range=0..20))  # -> Cells, Points
flatten_tree = FlattenTree(Tree=triangular.Cells, Path="{0}")
panel = Panel("""0
1""")
# using distance between points
point = Point(<point referenced from the Rhino model>)
list_item = ListItem(Index=panel, Wrap=True)
explode = Explode(Curve=flatten_tree, Recursive=True)  # -> Segments, Vertices
area = Area(Geometry=flatten_tree)  # -> Area, Centroid
graft_tree = GraftTree(Tree=area.Centroid, IncludeEmptyLists=True, IncludeNullItems=True)
evaluate_length = EvaluateLength(Curve=reparameterize(explode.Segments), Length="0.5", Normalized=True)  # -> Point, Tangent, Parameter
number_slider = Slider(0.56, range=0..1)
line = Line(StartPoint=evaluate_length.Point, EndPoint=graft_tree)
point_2 = Point(explode.Vertices)
unit_z = UnitZ(Factor=Slider(0.17, range=0..1))
construct_domain = ConstructDomain(DomainStart=Slider(0, range=0..1), DomainEnd=Slider(0.954, range=0..1))
move = Move(Geometry=graft_tree, Motion=unit_z)  # -> Geometry, Transform
panel_2 = Panel(move.Geometry)

distance = Distance(PointA=graft_tree, PointB=point)
construct_domain_2 = ConstructDomain(DomainStart=Slider(0, range=0..100), DomainEnd=Slider(1, range=0..1))

mass_addition = MassAddition(Input=distance)  # -> Result, PartialResults

number_slider_2 = Slider(4, range=0..20)
construct_domain_3 = ConstructDomain(DomainStart=Slider(1, range=0..1), DomainEnd=Slider(0, range=0..100))
construct_domain_4 = ConstructDomain(DomainStart=Slider(0, range=0..100), DomainEnd=number_slider_2)
remap_numbers = RemapNumbers(Value=mass_addition.Result, Source=construct_domain_4, Target=construct_domain_3)  # -> Mapped, Clipped
boolean = Boolean(remap_numbers.Clipped)
dispatch = Dispatch(List=remap_numbers.Clipped, DispatchPattern=boolean)  # -> ListA, ListB
sort_list = SortList(Keys=dispatch.ListA)  # -> reverse(Keys), ValuesA
list_item_2 = ListItem(List=sort_list.Keys, Index=0, Wrap=True)
replace_nulls = ReplaceNulls(Items=list_item_2, Replacements="0")  # -> Items, Count
panel_3 = Panel(list_item_2)

circle_cnr = CircleCNR(Center=point, Normal=Vector(0, 0, 1), Radius=number_slider_2)
data = Data(distance)

flatten_tree_2 = FlattenTree(Tree=mass_addition.Result, Path="{0}")
panel_4 = Panel(mass_addition.Result)
bounds = Bounds(Numbers=flatten_tree_2)
panel_5 = Panel(bounds)
remap_numbers_2 = RemapNumbers(Value=data, Source=bounds, Target=construct_domain_2)  # -> Mapped, Clipped

list_item_3 = ListItem(List=remap_numbers_2.Mapped, Index=0, Wrap=True)
remap_numbers_3 = RemapNumbers(Value=replace_nulls.Items, Source=Domain(0, 1), Target=construct_domain)  # -> Mapped, Clipped
list_item_4 = ListItem(List=remap_numbers_3.Mapped, Index=0, Wrap=True)
graph_mapper = GraphMapper(
    list_item_4,
    x0=0,
    x1=1,
    y0=0,
    y1=1,
    container_name="Sine",
    Equation_px=[0, 1],
    Equation_py=[0.004774868488, 0.9977939129])
evaluate_length_2 = EvaluateLength(Curve=reparameterize(line), Length=graph_mapper, Normalized=True)  # -> Point, Tangent, Parameter
weave = Weave(Pattern=[0, 1], Stream0=point_2, Stream1=evaluate_length_2.Point, NullGaps=False)
polyline = PolyLine(Vertices=weave, Closed=False)
extrude_point = ExtrudePoint(Base=polyline, Point=move.Geometry)
panel_6 = Panel(polyline)
