# Grasshopper definition test kangaroo.gh (Grasshopper 1.0.8)
# plug-ins: Kangaroo2 Components

curve = Curve([<curve referenced from the Rhino model> x4])
number_slider = Slider(9, range=0..10)
surface = Surface(curve)
mesh_surface = MeshSurface(Surface=surface, UCount=number_slider, VCount=number_slider, Overhang=True, Equalize=False)
combine_clean = CombineClean(Meshes=mesh_surface)
unify_mesh = UnifyMesh(Mesh=combine_clean)  # -> Result, Count
nakedvertices = NakedVertices(Mesh=unify_mesh.Result)  # -> ClothedIndex, NakedIndex, ClothedPts, NakedPts
curve_2 = Curve([<curve referenced from the Rhino model> x2])
point_in_curves = PointInCurves(Point=nakedvertices.NakedPts, Curves=curve_2)  # -> Relationship, Index, Point
show = Show(G=unify_mesh.Result)
vertexloads = VertexLoads(Mesh=unify_mesh.Result, Strength=Slider(0.2, range=0..1))
edgelengths = EdgeLengths(Mesh=unify_mesh.Result, LengthFactor=1, Strength=1)
equality = Equality(FirstNumber=point_in_curves.Relationship, SecondNumber="0")  # -> Equality, Inequality
cull_pattern = CullPattern(List=nakedvertices.NakedPts, CullPattern=equality.Equality)
anchor = Anchor(Point=cull_pattern, Strength=10000)
entwine = Entwine(Branch00=show, Branch01=vertexloads, Branch02=anchor, Branch03=edgelengths, FlattenInputs=True)
solver = Solver(GoalObjects=entwine, Reset=Button(), Threshold=1e-15, Tolerance=0.0001, On=Toggle(False))  # -> I, V, O
