# Grasshopper definition week 3 spiral stairs.gh (Grasshopper 1.0.8)

x_coordinate = Slider(1174.76, range=0..10000)
number_slider = Slider(1871, range=0..5000)
construct_point = ConstructPoint(XCoordinate=0, YCoordinate=0, ZCoordinate=0)
x_coordinate_2 = Slider(1174.76, range=0..10000)
length = Slider(2543.151, range=0..10000)
division = Division(A=number_slider, B=Slider(20, range=0..100))
construct_domain = ConstructDomain(DomainStart=Slider(0, range=0..1000), DomainEnd=number_slider)
unit_x = UnitX(Factor=1)
construct_point_2 = ConstructPoint(XCoordinate=x_coordinate, YCoordinate=0, ZCoordinate=0)
addition = Addition(A=x_coordinate, B=length)
circle_cnr = CircleCNR(Center=construct_point, Normal=Vector(0, 0, 1), Radius=x_coordinate)
construct_point_3 = ConstructPoint(XCoordinate=x_coordinate_2, YCoordinate=0, ZCoordinate=0)
circle_cnr_2 = CircleCNR(Center=construct_point, Normal=Vector(0, 0, 1), Radius=addition)
unit_z = UnitZ(Factor=1)
range = Range(Domain=construct_domain, Steps=division)
construct_point_4 = ConstructPoint(XCoordinate=0, YCoordinate=0, ZCoordinate=0)
line_sdl = LineSDL(Start=construct_point_2, Direction=unit_x, Length=length)
xy_plane = XYPlane(Origin=Point(0, 0, 0))
degrees = Slider(165, range=0..360)
degrees_2 = Slider(76, range=0..360)
line_sdl_2 = LineSDL(Start=construct_point_4, Direction=unit_z, Length=1)
rotate = Rotate(Geometry=construct_point_3, Angle=range, Plane=xy_plane)  # -> Geometry, Transform
panel = Panel(range)
radians = Radians(Degrees=degrees_2)
radians_2 = Radians(Degrees=degrees)
construct_domain_2 = ConstructDomain(DomainStart=radians, DomainEnd=radians_2)
revolution = Revolution(Curve=line_sdl, Axis=line_sdl_2, Domain=construct_domain_2)
interpolate = Interpolate(Vertices=rotate.Geometry, Degree=3, Periodic=False, KnotStyle=1)  # -> Curve, Length, Domain
repeat_data = RepeatData(Data="300", Length="10")
merge = Merge(Data1=flatten(repeat_data), Data2=flatten("1000"))
length_2 = Length(Curve=interpolate.Curve)
mass_addition = MassAddition(Input=merge)  # -> Result, PartialResults
division_2 = Division(A=mass_addition.PartialResults, B=length_2)
shatter = Shatter(Curve=reparameterize(interpolate.Curve), Parameters=division_2)
cull_index = CullIndex(List=shatter, Indices="-1", Wrap=True)
scale = Scale(Geometry=cull_index, Center=Point(0, 0, 0), Factor=Slider(4, range=1..10))  # -> Geometry, Transform
ruled_surface = RuledSurface(CurveA=cull_index, CurveB=scale.Geometry)
list_length = ListLength(List=ruled_surface)
series = Series(Start="150", Step="150", Count=list_length)
geometry = Geometry(<brep referenced from the Rhino model>)
unit_z_2 = UnitZ(Factor=series)
move = Move(Geometry=cull_index, Motion=unit_z_2)  # -> Geometry, Transform
curve = Curve(move.Geometry)
move_2 = Move(Geometry=ruled_surface, Motion=unit_z_2)  # -> Geometry, Transform
tread_height = Slider(200, range=0..1000)
horizontal_frame = HorizontalFrame(Curve=reparameterize(curve), Parameter="0.5")
group = Group(Objects=geometry)
xy_plane_2 = XYPlane(Origin=Point(0, 0, 0))
dispatch = Dispatch(List=horizontal_frame, DispatchPattern="0")  # -> ListA, ListB
surface_box = SurfaceBox(Surface=move_2.Geometry, Domain=move_2.Geometry, Height=tread_height)
bounding_box = BoundingBox(Content=group, Plane=PlaneXY(0, 0, 0))  # -> Box, Box_2
orient = Orient(Geometry=group, Source=xy_plane_2, Target=dispatch.ListB)  # -> Geometry, Transform
box_morph = BoxMorph(Geometry=group, Reference=bounding_box.Box, Target=surface_box)
