# Grasshopper definition week 7 kangaroo test.gh (Grasshopper 1.0.8)
# plug-ins: Kangaroo2 Components

mesh_plane = MeshPlane(Boundary={Plane=PlaneXY(0, 0, 0), Size=Domain2(u=-10..10, v=-10..10)}, WidthCount=10, HeightCount=10)  # -> Mesh, Area
nakedvertices = NakedVertices(Mesh=mesh_plane.Mesh)  # -> ClothedIndex, NakedIndex, ClothedPts, NakedPts
deconstruct_mesh = DeconstructMesh(Mesh=mesh_plane.Mesh)  # -> Vertices, Faces, Colours, Normals
edgelengths = EdgeLengths(Mesh=mesh_plane.Mesh, LengthFactor=Slider(0.568, range=0..10), Strength=1)
load = Load(Point=deconstruct_mesh.Vertices, ForceVector=Vector(0, 0, 1), Weighting=1)
point = Point([<point referenced from the Rhino model> x4])
pressure = Pressure(M=mesh_plane.Mesh, Strength=1)
closest_point = ClosestPoint(Point=point, Cloud=deconstruct_mesh.Vertices)  # -> ClosestPoint, CPIndex, Distance
merge = Merge(Data1=edgelengths, Data2=load, Data3=pressure)
anchor = Anchor(Point=nakedvertices.NakedPts, Strength=10000)
stepsolver = StepSolver(
    GoalObjects=flatten([anchor, merge]),
    Tolerance=0.0001,
    Momentum=False,
    Damping=0.99,
    SubIterations="1",
    Animate=Slider(11, range=0..100))  # -> I, V, O
