# Grasshopper definition week 8 class.gh (Grasshopper 1.0.8)
# plug-ins: Human, Redback-Beta.GH

panel = Panel("""Default
Layer 01
Layer 02""")
cylinder = Cylinder(Base=PlaneXY(0, 0, 0), Radius=0.5, Length=1)
query_viewports = QueryViewports(AutoUpdateState=True)
surface = Surface(<surface referenced from the Rhino model>)
construct_point = ConstructPoint(XCoordinate=0, YCoordinate=0, ZCoordinate=0)
query_model_objects = QueryModelObjects(Layer=panel, Locked=True, Hidden=True, AutoUpdateState=True)
scale = Scale(Geometry=cylinder, Center=Point(0, 0, 0), Factor="1000")  # -> Geometry, Transform
list_item = ListItem(List=query_viewports, Index=0, Wrap=True)
clean_tree = CleanTree(RemoveNulls=True, RemoveInvalid=True, RemoveEmpty=Toggle(True), Tree=query_model_objects)
evaluate_surface = EvaluateSurface(Surface=surface, Point=construct_point)  # -> Point, Normal, UDirection, VDirection, Frame
panel_2 = Panel("""Default
Layer 1
Layer 2""")
model_object = ModelObject(Object=clean_tree)  # -> Object, Geometry, Name, Layer, Visibility, Display, Drafting, Render
make2d = Make2D(Geometry=scale.Geometry, View=list_item, TangentEdges=False, TangentSeams=False, AutoComputeMake2D=False)  # -> VisibleCurves, VisibleIndex, VisibleType, HiddenCurves, HiddenIndex, HiddenType
bounding_box = BoundingBox(Content=surface, Plane=evaluate_surface.Frame)  # -> Box, Box_2
dynamic_geometry_pipeline = DynamicGeometryPipeline(
    LayerFilter=panel_2,
    TypeFilter="Curve",
    NameFilter="*",
    GroupByLayer=False,
    GroupByType=False,
    IncludeHidden=True,
    IncludeLocked=True,
    enableFullPath=False,
    listenToAttributes=True)
model_layer = ModelLayer(Layer=model_object.Layer)  # -> Layer, Name, Hidden, Locked, DisplayColour, Material, Linetype
deconstruct_box = DeconstructBox(Box=bounding_box.Box)  # -> Plane, X, Y, Z
curve = Curve(model_object.Geometry)
panel_3 = Panel("""*{
fill: none;
stroke: #ff00b4;
stroke-width: 0.2mm;
stroke-linecap: round;
stroke-linejoin: round;
}
[Layer="Default"]{stroke-width: 0.5mm;
fill: none;
}
[Layer="Layer 01"]{stroke-dasharray: 1mm 0.5mm;
fill: none;
}""")
curve_to_polyline = CurveToPolyline(Curve=curve, ToleranceDistance="0.1", ToleranceAngle=0)  # -> Polyline, Segments
panel_4 = Panel("{\"class\":\"demo\"}")
rectangle = Rectangle(Plane=deconstruct_box.Plane, XSize=deconstruct_box.X, YSize=deconstruct_box.Y, Radius=0)  # -> Rectangle, Length
graft_tree = GraftTree(Tree=model_layer.Name, IncludeEmptyLists=True, IncludeNullItems=True)
panel_5 = Panel(model_layer.Name)
list_item_2 = ListItem(List=model_layer.Name, Index=0, Wrap=True)
create_json = CreateJSON(Keys="Layer", Values=graft_tree)
image_object = ImageObject(RE=rectangle.Rectangle, ImagePath="Screenshot 2024-09-16 at 11.58.19 am")
unflatten_tree = UnflattenTree(Tree=create_json, Guide=curve_to_polyline.Polyline)
xy_plane = XYPlane(Origin=Point(0, 0, 0))
panel_6 = Panel(list_item_2)
relative_path = RelativePath(Path=Toggle(True), RelativePath="svgdemo.svg")  # -> FullPath, Directory, FileName
panel_7 = Panel(create_json)
geo2arch = Geo2Arch(Geometry=[curve_to_polyline.Polyline, make2d.VisibleCurves], Properties=unflatten_tree)
panel_8 = Panel(unflatten_tree)
panel_9 = Panel(curve_to_polyline.Polyline)
geo2arch_2 = Geo2Arch(Geometry=image_object, Properties="{}")
svg_layout = SVGLayout(Plane=xy_plane, Dimensions="420,297", Scale="1:10", Location=Toggle(True))  # -> L, R
replace_text = ReplaceText(Text="svgdemo.svg", Find="#", Replace=list_item_2, RecursiveReplace=False)
panel_10 = Panel(svg_layout.L)
svg_generator = SVGGenerator(JO=geo2arch_2, LA=svg_layout.L)
panel_11 = Panel(geo2arch)
relative_path_2 = RelativePath(Path=Toggle(False), RelativePath=replace_text)  # -> FullPath, Directory, FileName
svg_generator_2 = SVGGenerator(JO=geo2arch, LA=svg_layout.L, CSS=panel_3)
relative_path_3 = RelativePath(Path=Toggle(True), RelativePath="imagedemo.svg")  # -> FullPath, Directory, FileName
panel_12 = Panel(relative_path_2.FullPath)
write_file = WriteFile(Run=Toggle(True), Content=svg_generator_2, FileDirectory=relative_path.Directory, FileName=relative_path.FileName)
write_file_2 = WriteFile(Run=Toggle(True), Content=svg_generator, FileDirectory=relative_path_3.Directory, FileName=relative_path_3.FileName)
panel_13 = Panel(svg_generator_2)
panel_14 = Panel(write_file_2)
panel_15 = Panel(write_file)
