# Grasshopper definition week2.gh (Grasshopper 1.0.8)
# plug-ins: RhinoCodePluginGH

panel = Panel("number of threads")
number_slider = Slider(6, range=0..10)
crv = Curve(<curve referenced from the Rhino model>)
crv_2 = Curve()
crv_3 = Curve(<curve referenced from the Rhino model>)
topflamng = IronPython2Script(topFlange=crv_3, bottomFlange=crv)  # -> out, trussWebs; inputs topFlange: Curve, bottomFlange: Curve
# ---------- topflamng: IronPython ----------
import ghpythonlib.components as ghc
# Point A
trussDivision = 10

topPoints = ghc.DivideCurve(topFlange, trussDivision, False)
bottomPoints = ghc.DivideCurve(bottomFlange, trussDivision, False)

# Point C
topPoints = ghc.Dispatch(topPoints["points"],[False,True])
bottomPoints = ghc.Dispatch(bottomPoints["points"],[False,True])

#print(topPoints)

#Point D
trussPoints = ghc.Weave([1,0],topPoints["list_a"],bottomPoints["list_b"])
print(trussPoints)

trussWebs = ghc.PolyLine(trussPoints, False)
# ---------- end topflamng ----------
panel_2 = Panel("height of stairs")
dom = ConstructDomain(DomainStart=Slider(0, range=0..10), DomainEnd=Slider(10, range=0..10))
series = Series(Start="2", Step="5", Count="10")
divide = DivideCurve(Curve=crv, Count=number_slider, Kinks=False)  # -> Points, Tangents, Parameters
divide_2 = DivideCurve(Curve=crv_3, Count=number_slider, Kinks=False)  # -> Points, Tangents, Parameters
panel_3 = Panel("expression - x-1")
range = Range(Domain=dom, Steps=expr("x-1", "10"))
panel_4 = Panel("""0
1""")
ln = Line(StartPoint=divide_2.Points, EndPoint=divide.Points)
item = ListItem(List=range, Index="0", Wrap=True)  # -> Item, Item1
short = ShortestList(ListA=series, ListB=range, TrimMode=2)  # -> ListA, ListB
panel_5 = Panel(series)
panel_6 = Panel(range)
dispatch = Dispatch(List=divide.Points, DispatchPattern=panel_4)  # -> ListA, ListB
subtraction = Subtraction(A=item.Item1, B=item.Item)
dispatch_2 = Dispatch(List=divide_2.Points, DispatchPattern=panel_4)  # -> ListA, ListB
pt = ConstructPoint(XCoordinate=short.ListA, YCoordinate=short.ListB, ZCoordinate=0)
panel_7 = Panel(subtraction)
pt_2 = Point(dispatch.ListB)
Y = UnitY(Factor=subtraction)
pt_3 = Point(dispatch_2.ListA)
panel_8 = Panel(pt)
panel_9 = Panel("""0
1""")
weave = Weave(Pattern=panel_4, Stream0=pt_2, Stream1=pt_3, NullGaps=False)
panel_10 = Panel(Y)
move = Move(Geometry=pt, Motion=Y)  # -> Geometry, Transform
pline = PolyLine(Vertices=weave, Closed=False)
weave_2 = Weave(Pattern=panel_9, Stream0=pt, Stream1=move.Geometry, NullGaps=False)
panel_11 = Panel("""-1
-2""")
points = PointList(Points=weave_2)
order = PointOrder(Points=weave_2)
cull_i = CullIndex(List=weave_2, Indices=panel_11, Wrap=True)
bbox = BoundingBox(Content=cull_i, Plane=PlaneXY(0, 0, 0), UnionBox=True)  # -> Box, Box_2
debox = DeconstructBox(Box=bbox.Box)  # -> Plane, X, Y, Z
panel_12 = Panel(bbox.Box)
planesrf = PlaneSurface(Plane=debox.Plane, XSize=debox.X, YSize=debox.Y)
srf = Surface(<surface referenced from the Rhino model>)
pline_2 = PolyLine(Vertices=cull_i, Closed=False)
crv_4 = Curve(<curve referenced from the Rhino model>)
crv_5 = Curve(<curve referenced from the Rhino model>)
srf_cp = SurfaceClosestPoint(Point=cull_i, Surface=reparameterize(planesrf))  # -> Point, UVPoint, Distance
Z = UnitZ(Factor=Slider(16, range=0..20))
Z_2 = UnitZ(Factor=Slider(16, range=0..20))
pdecon = Deconstruct(Point=srf_cp.UVPoint)  # -> XComponent, YComponent, ZComponent
extr = Extrude(Base=crv_4, Direction=Z)
extr_2 = Extrude(Base=crv_5, Direction=Z_2)
pt_4 = ConstructPoint(XCoordinate=pdecon.YComponent, YCoordinate=pdecon.XComponent, ZCoordinate=0)
subtraction_2 = Subtraction(A="1", B=pdecon.XComponent)
evalsrf = EvaluateSurface(Surface=reparameterize(extr), Point=pt_4)  # -> Point, Normal, UDirection, VDirection, Frame
evalsrf_2 = EvaluateSurface(Surface=reparameterize(extr_2), Point=pt_4)  # -> Point, Normal, UDirection, VDirection, Frame
panel_13 = Panel(srf_cp.UVPoint)
pline_3 = PolyLine(Vertices=evalsrf.Point, Closed=False)
pline_4 = PolyLine(Vertices=evalsrf_2.Point, Closed=False)
pull = PullCurve(Curve=pline_4, Surface=extr_2)
loft = Loft(Curves=[pull, pline_3], Options={Adjust=False, Closed=False, LoftEnds=0, LoftSimp=0, LoftType=0, Rebuild=10, Refit=0.01})
