# Grasshopper definition wk 1 grasshopper.gh (Grasshopper 1.0.7)

pt = Point(<point referenced from the Rhino model>)
Z = UnitZ(Factor=1)
crv = Curve([<curve referenced from the Rhino model> x2])
sph = Sphere(Base=pt, Radius=1)
extr = Extrude(Base=crv, Direction=Z)
loft = Loft(Curves=crv, Options={Adjust=False, Closed=False, LoftEnds=0, LoftSimp=0, LoftType=0, Rebuild=10, Refit=0.01})
panel = Panel(crv)
dom = ConstructDomain(DomainStart=Slider(1.688, range=0..10), DomainEnd=Slider(0.807, range=0..1))
pt_2 = Point([<point referenced from the Rhino model> x7])
lng = ListLength(List=pt_2)
random = Random(Range=dom, Number=lng, Seed=2)
lng_2 = ListLength(List=pt_2)
graft = GraftTree(Tree=random, IncludeEmptyLists=True, IncludeNullItems=True)
graft_2 = GraftTree(Tree=pt_2, IncludeEmptyLists=True, IncludeNullItems=True)
circle = CircleCNR(Center=graft_2, Normal=Vector(0, 0, 1), Radius=Slider(0.215, range=0..10))
random_2 = Random(Range="360", Number=lng_2, Seed="7000")
circle_2 = CircleCNR(Center=graft_2, Normal=Vector(0, 0, 1), Radius=graft)
panel_2 = Panel(random_2)
eval = EvaluateCurve(Curve=reparameterize(circle_2), Parameter=[Slider(0.613, range=0..1), Slider(0.511, range=0..1)])  # -> Point, Tangent, Angle
graft_3 = GraftTree(Tree=random_2, IncludeEmptyLists=True, IncludeNullItems=True)
ln = Line(StartPoint=graft_2, EndPoint=eval.Point)
trim = TrimWithRegion(Curve=ln, Region=circle)  # -> Inside, Outside
crv_2 = Curve(trim.Outside)
pshift = ShiftPaths(Data=crv_2, Offset="-1")
rotate = Rotate(Geometry=pshift, Angle=degrees(graft_3), Plane=graft_2)  # -> Geometry, Transform
