# Grasshopper definition wk 2 parastairs.gh (Grasshopper 1.0.8)

construct_point = ConstructPoint(XCoordinate=0, YCoordinate=0, ZCoordinate=0)
number_slider = Slider(3.4, range=0..10)
number_slider_2 = Slider(26, range=0..100)
number_slider_3 = Slider(25, range=0..100)
unit_x = UnitX(Factor=Slider(76, range=0..100))
point = Point(construct_point)
move = Move(Geometry=point, Motion=unit_x)  # -> Geometry, Transform
series = Series(Start=0, Step=number_slider_2, Count=number_slider_3)
unit_y = UnitY(Factor=series)
series_2 = Series(Start=0, Step=number_slider, Count=number_slider_3)
multiplication = Multiplication(A=number_slider, B=number_slider_3)
line = Line(StartPoint=point, EndPoint=move.Geometry)
subtraction = Subtraction(A=multiplication, B=number_slider)
unit_z = UnitZ(Factor=multiplication)
move_2 = Move(Geometry=line, Motion=unit_y)  # -> Geometry, Transform
unit_x_2 = UnitX(Factor=Slider(140, range=0..200))
unit_z_2 = UnitZ(Factor=series_2)
negative = Negative(Value=unit_x_2)
move_3 = Move(Geometry=move_2.Geometry, Motion=negative)  # -> Geometry, Transform
move_4 = Move(Geometry=move_2.Geometry, Motion=unit_z_2)  # -> Geometry, Transform
move_5 = Move(Geometry=move_3.Geometry, Motion=unit_z)  # -> Geometry, Transform
end_points = EndPoints(Curve=move_4.Geometry)  # -> Start, End
end_points_2 = EndPoints(Curve=move_5.Geometry)  # -> Start, End
line_2 = Line(StartPoint=end_points.Start, EndPoint=end_points_2.End)
join_curves = JoinCurves(Curves=flatten([move_4.Geometry, move_5.Geometry, line_2]), Preserve=False)
fillet = Fillet(Curve=join_curves, Radius=Slider(25, range=0..100))
number_slider_4 = Slider(2, range=0..10)
offset_curve = OffsetCurve(Curve=fillet, Distance=number_slider, Corners=1)
end_points_3 = EndPoints(Curve=offset_curve)  # -> Start, End
end_points_4 = EndPoints(Curve=fillet)  # -> Start, End
unit_y_2 = UnitY(Factor=number_slider_2)
line_3 = Line(StartPoint=graft(end_points_4.Start), EndPoint=end_points_3.Start)
line_4 = Line(StartPoint=graft(end_points_4.End), EndPoint=end_points_3.End)
negative_2 = Negative(Value=unit_y_2)
join_curves_2 = JoinCurves(Curves=flatten([offset_curve, fillet, line_3]), Preserve=False)
boundary_surfaces = BoundarySurfaces(Edges=join_curves_2)
extrude = Extrude(Base=boundary_surfaces, Direction=negative_2)
