# Grasshopper definition wk 2 stair design.gh (Grasshopper 1.0.8)

construct_point = ConstructPoint(XCoordinate=0, YCoordinate=0, ZCoordinate=0)
inside_diameter = Slider(2400, range=0..2500)
point = Point(construct_point)
division = Division(A=inside_diameter, B=2)
stair_width = Slider(1200, range=0..1200)
no_of_treads = Slider(26, range=0..100)
circle = Circle(Plane=point, Radius=division)
offset_curve = OffsetCurve(Curve=circle, Distance=stair_width, Corners=1)
end_points = EndPoints(Curve=circle)  # -> Start, End
division_2 = Division(A="360", B=no_of_treads)
boundary_surfaces = BoundarySurfaces(Edges=flatten([circle, offset_curve]))
end_points_2 = EndPoints(Curve=offset_curve)  # -> Start, End
addition = Addition(A=no_of_treads, B=1)
line = Line(StartPoint=end_points.Start, EndPoint=end_points_2.Start)
unit_y = UnitY(Factor=Slider(500, range=0..1000))
series = Series(Start=0, Step=division_2, Count=no_of_treads)
series_2 = Series(Start=0, Step=division_2, Count=addition)
rotate = Rotate(Geometry=line, Angle=degrees(division_2), Plane=point)  # -> Geometry, Transform
treads_for_landing = Slider(4, range=0..10)
domain_box = DomainBox(Base=PlaneXY(0, 0, 0), X=Slider(12536, range=0..100000), Y=Slider(3000, range=0..5000), Z=Slider(300, range=0..1000))
ellipse = Ellipse(Plane=PlaneXY(0, 0, 0), Radius1=Slider(213, range=0..1000), Radius2=Slider(140, range=0..1000))  # -> Ellipse, Focus1, Focus2
move = Move(Geometry=ellipse.Ellipse, Motion=unit_y)  # -> Geometry, Transform
deconstruct_brep = DeconstructBrep(Brep=domain_box)  # -> Faces, Edges, Vertices
surface_split = SurfaceSplit(Surface=boundary_surfaces, Curves=[line, rotate.Geometry])
number_slider = Slider(4431, range=0..9000)
unit_z = UnitZ(Factor=number_slider)
curve = Curve(deconstruct_brep.Edges)
subtraction = Subtraction(A=treads_for_landing, B=1)
extrude = Extrude(Base=ellipse.Ellipse, Direction=unit_z)
list_item = ListItem(List=surface_split, Index=0, Wrap=True)  # -> Item, Item1
point_on_curve = PointOnCurve(curve, parameter=0.5)
end_points_3 = EndPoints(Curve=line)  # -> Start, End
subtraction_2 = Subtraction(A=no_of_treads, B=subtraction)
unit_z_2 = UnitZ(Factor=number_slider)
series_3 = Series(Start=0, Step=division_2, Count=addition)
tread_height = Slider(200, range=0..1000)
surface = Surface(list_item.Item)
series_4 = Series(Start=0, Step=1, Count=Slider(11, range=0..12))
point_list = PointList(Points=point_on_curve, Size=Slider(6, range=0..10))
point_2 = Point(end_points_3.Start)
unit_z_3 = UnitZ(Factor=tread_height)
rotate_2 = Rotate(Geometry=end_points_2.Start, Angle=degrees(series_2), Plane=point)  # -> Geometry, Transform
curve_closest_point = CurveClosestPoint(Point=rotate_2.Geometry, Curve=offset_curve)  # -> Point, Parameter, Distance
shatter = Shatter(Curve=offset_curve, Parameters=curve_closest_point.Parameter)
rotate_3 = Rotate(Geometry=surface, Angle=degrees(series), Plane=point)  # -> Geometry, Transform
rotate_4 = Rotate(Geometry=point_2, Angle=degrees(series_3), Plane=PlaneXY(0, 0, 0))  # -> Geometry, Transform
curve_closest_point_2 = CurveClosestPoint(Point=rotate_4.Geometry, Curve=circle)  # -> Point, Parameter, Distance
fillet_edge = FilletEdge(Shape=domain_box, Blend=0, Metric=0, Edges=series_4, Radii=Slider(108, range=0..500))
move_2 = Move(Geometry=fillet_edge, Motion=unit_z_2)  # -> Geometry, Transform
multiplication = Multiplication(A=subtraction_2, B=tread_height)
series_5 = Series(Start=0, Step=tread_height, Count=subtraction_2)
shatter_2 = Shatter(Curve=circle, Parameters=curve_closest_point_2.Parameter)
addition_2 = Addition(A=subtraction_2, B=1)
move_3 = Move(Geometry=line, Motion=unit_z_3)  # -> Geometry, Transform
unit_z_4 = UnitZ(Factor=tread_height)
list_item_2 = ListItem(List=shatter, Index=0, Wrap=True)
unit_z_5 = UnitZ(Factor=Slider(378, range=0..1000))
unit_z_6 = UnitZ(Factor=series_5)
list_item_3 = ListItem(List=shatter_2, Index=0, Wrap=True)
number_slider_2 = Slider(900, range=0..900)
end_points_4 = EndPoints(Curve=move_3.Geometry)  # -> Start, End
series_6 = Series(Start=0, Step=tread_height, Count=addition_2)
unit_z_7 = UnitZ(Factor=tread_height)
move_4 = Move(Geometry=rotate_3.Geometry, Motion=unit_z_6)  # -> Geometry, Transform
move_5 = Move(Geometry=list_item_2, Motion=unit_z_4)  # -> Geometry, Transform
unit_z_8 = UnitZ(Factor=series_6)
move_6 = Move(Geometry=rotate_4.Geometry, Motion=unit_z_8)  # -> Geometry, Transform
move_7 = Move(Geometry=rotate_2.Geometry, Motion=unit_z_8)  # -> Geometry, Transform
unit_z_9 = UnitZ(Factor=number_slider_2)
move_8 = Move(Geometry=move_6.Geometry, Motion=unit_z_9)  # -> Geometry, Transform
move_9 = Move(Geometry=end_points_4.End, Motion=unit_z_5)  # -> Geometry, Transform
move_10 = Move(Geometry=end_points_4.Start, Motion=unit_z_5)  # -> Geometry, Transform
unit_z_10 = UnitZ(Factor=tread_height)
number_slider_3 = Slider(200, range=0..1000)
no_of_floors = Slider(4, range=0..10)
move_11 = Move(Geometry=list_item_3, Motion=unit_z_7)  # -> Geometry, Transform
interpolate = Interpolate(Vertices=move_8.Geometry, Degree=3, Periodic=False, KnotStyle=1)  # -> Curve, Length, Domain
move_12 = Move(Geometry=move_7.Geometry, Motion=unit_z_9)  # -> Geometry, Transform
nurbs_curve = NurbsCurve(Vertices=move_7.Geometry, Degree=3, Periodic=False)  # -> Curve, Length, Domain
list_item_4 = ListItem(List=move_8.Geometry, Index=0, Wrap=True)
extrude_2 = Extrude(Base=move_4.Geometry, Direction=unit_z_10)
number_slider_4 = Slider(2, range=0..10)
unit_x = UnitX(Factor=1)
series_7 = Series(Start=0, Step=multiplication, Count=no_of_floors)
interpolate_2 = Interpolate(Vertices=move_12.Geometry, Degree=3, Periodic=False, KnotStyle=1)  # -> Curve, Length, Domain
unit_z_11 = UnitZ(Factor=tread_height)
negative = Negative(Value=number_slider_3)
list_item_5 = ListItem(List=move_12.Geometry, Index=0, Wrap=True)
move_13 = Move(Geometry=list_item_4, Motion=unit_z_11)  # -> Geometry, Transform
division_3 = Division(A=number_slider_3, B="2")
unit_z_12 = UnitZ(Factor=series_7)
end_points_5 = EndPoints(Curve=interpolate.Curve)  # -> Start, End
negative_2 = Negative(Value=Slider(900, range=0..900))
unit_z_13 = UnitZ(Factor=division_3)
nurbs_curve_2 = NurbsCurve(
    Vertices=[list_item_5, move_9.Geometry, end_points_4.End, end_points_4.Start, move_10.Geometry, list_item_4],
    Degree=number_slider_4,
    Periodic=False)  # -> Curve, Length, Domain
series_8 = Series(Start=0, Step=tread_height, Count=subtraction_2)
subtraction_3 = Subtraction(A=division_2, B=Slider(1.617, range=0..10))
move_14 = Move(Geometry=graft(nurbs_curve.Curve), Motion=unit_z_12)  # -> Geometry, Transform
move_15 = Move(Geometry=graft(extrude_2), Motion=unit_z_12)  # -> Geometry, Transform
offset_curve_2 = OffsetCurve(Curve=interpolate.Curve, Distance=negative, Plane=unit_x, Corners=1)
offset_curve_3 = OffsetCurve(Curve=interpolate_2.Curve, Distance=number_slider_3, Plane=unit_x, Corners=1)
end_points_6 = EndPoints(Curve=interpolate_2.Curve)  # -> Start, End
move_16 = Move(Geometry=list_item_5, Motion=unit_z_11)  # -> Geometry, Transform
unit_z_14 = UnitZ(Factor=negative_2)
unit_z_15 = UnitZ(Factor=Slider(200, range=0..1000))
end_points_7 = EndPoints(Curve=offset_curve_3)  # -> Start, End
unit_z_16 = UnitZ(Factor=number_slider_2)
unit_z_17 = UnitZ(Factor=series_8)
join_curves = JoinCurves(Curves=flatten(move_14.Geometry), Preserve=False)
end_points_8 = EndPoints(Curve=offset_curve_2)  # -> Start, End
addition_3 = Addition(A=end_points_8.Start, B=end_points_5.Start)
division_4 = Division(A=addition_3, B="2")
move_17 = Move(Geometry=division_4, Motion=unit_z_13)  # -> Geometry, Transform
extrude_3 = Extrude(Base=offset_curve_2, Direction=unit_z_14)
addition_4 = Addition(A=end_points_6.Start, B=end_points_7.Start)
nurbs_curve_3 = NurbsCurve(
    Vertices=[move_16.Geometry, move_9.Geometry, end_points_4.End, end_points_4.Start, move_10.Geometry, move_13.Geometry],
    Degree=number_slider_4,
    Periodic=False)  # -> Curve, Length, Domain
extrude_4 = Extrude(Base=offset_curve_3, Direction=unit_z_14)
negative_3 = Negative(Value=unit_z_15)
multiplication_2 = Multiplication(A=number_slider_3, B="2")
move_18 = Move(Geometry=offset_curve_2, Motion=unit_z_14)  # -> Geometry, Transform
move_19 = Move(Geometry=offset_curve_3, Motion=unit_z_14)  # -> Geometry, Transform
move_20 = Move(Geometry=join_curves, Motion=negative_3)  # -> Geometry, Transform
arc_3pt = Arc3Pt(PointA=end_points_8.Start, PointB=move_17.Geometry, PointC=end_points_5.Start)  # -> Arc, Plane, Radius
division_5 = Division(A=addition_4, B="2")
division_6 = Division(A=number_slider_3, B="2")
move_21 = Move(Geometry=join_curves, Motion=unit_z_16)  # -> Geometry, Transform
rotate_5 = Rotate(Geometry=nurbs_curve_3.Curve, Angle=degrees(subtraction_3), Plane=PlaneXY(0, 0, 0))  # -> Geometry, Transform
unit_z_18 = UnitZ(Factor=division_6)
end_points_9 = EndPoints(Curve=move_18.Geometry)  # -> Start, End
end_points_10 = EndPoints(Curve=move_19.Geometry)  # -> Start, End
addition_5 = Addition(A=stair_width, B=multiplication_2)
loft = Loft(
    Curves=flatten([move_20.Geometry, move_21.Geometry]),
    Options={Adjust=False, Closed=False, LoftEnds=0, LoftSimp=0, LoftType=0, Rebuild=10, Refit=0.01})
sweep2 = Sweep2(Rail1=interpolate.Curve, Rail2=offset_curve_2, Sections=arc_3pt.Arc, SameHeight=False)
division_7 = Division(A=addition_5, B="2")
move_22 = Move(Geometry=division_5, Motion=unit_z_18)  # -> Geometry, Transform
addition_6 = Addition(A=end_points_10.Start, B=end_points_9.Start)
rotate_6 = Rotate(Geometry=rotate_5.Geometry, Angle=degrees(series_2), Plane=PlaneXY(0, 0, 0))  # -> Geometry, Transform
arc_3pt_2 = Arc3Pt(PointA=end_points_6.Start, PointB=move_22.Geometry, PointC=end_points_7.Start)  # -> Arc, Plane, Radius
sweep2_2 = Sweep2(Rail1=offset_curve_3, Rail2=offset_curve_2, Sections=arc_3pt_2.Arc, SameHeight=False)
rotate_7 = Rotate(Geometry=nurbs_curve_2.Curve, Angle=degrees(series_2), Plane=PlaneXY(0, 0, 0))  # -> Geometry, Transform
negative_4 = Negative(Value=division_7)
unit_z_19 = UnitZ(Factor=negative_4)
division_8 = Division(A=addition_6, B="2")
move_23 = Move(Geometry=division_8, Motion=unit_z_19)  # -> Geometry, Transform
move_24 = Move(Geometry=rotate_6.Geometry, Motion=unit_z_17)  # -> Geometry, Transform
move_25 = Move(Geometry=rotate_7.Geometry, Motion=unit_z_17)  # -> Geometry, Transform
panel = Panel("""50
51
52
53
53""")
arc_3pt_3 = Arc3Pt(PointA=end_points_10.Start, PointB=move_23.Geometry, PointC=end_points_9.Start)  # -> Arc, Plane, Radius
cull_index = CullIndex(List=move_25.Geometry, Indices=panel, Wrap=True)
weave = Weave(Pattern=[0, 1], Stream0=cull_index, Stream1=move_24.Geometry, NullGaps=False)
end_points_11 = EndPoints(Curve=weave)  # -> Start, End
geometry = Geometry(end_points_11.End)
pull_point = PullPoint(Point=geometry, Geometry=interpolate.Curve, ClosestOnly=True)  # -> ClosestPoint, Distance
sweep2_3 = Sweep2(Rail1=move_19.Geometry, Rail2=move_18.Geometry, Sections=arc_3pt_3.Arc, SameHeight=False)
panel_2 = Panel(cull_index)
negative_5 = Negative(Value=pull_point.Distance)
extend_curve = ExtendCurve(Curve=weave, Type=0, Start=negative_5, End=negative_5)
loft_2 = Loft(Curves=extend_curve, Options={Adjust=False, Closed=False, LoftEnds=0, LoftSimp=0, LoftType=2, Rebuild=10, Refit=0.01})
