# Grasshopper definition wk1 grasshopper.gh (Grasshopper 1.0.7)

pt = Point(<point referenced from the Rhino model>)
Z = UnitZ(Factor=1)
crv = Curve([<curve referenced from the Rhino model> x2])
sph = Sphere(Base=pt, Radius=1)
panel = Panel(crv)
extr = Extrude(Base=crv, Direction=Z)
loft = Loft(Curves=crv, Options={Adjust=False, Closed=False, LoftEnds=0, LoftSimp=0, LoftType=0, Rebuild=10, Refit=0.01})
pt_2 = Point([<point referenced from the Rhino model> x10])
dom = ConstructDomain(DomainStart=Slider(7.852, range=0..40), DomainEnd=Slider(0.8, range=0..40))
lng = ListLength(List=pt_2)
random = Random(Range=dom, Number=lng, Seed=2)
graft = GraftTree(Tree=random, IncludeEmptyLists=True, IncludeNullItems=True)
graft_2 = GraftTree(Tree=pt_2, IncludeEmptyLists=True, IncludeNullItems=True)
lng_2 = ListLength(List=pt_2)
circle = CircleCNR(Center=graft_2, Normal=Vector(0, 0, 1), Radius=graft)
panel_2 = Panel(lng_2)
circle_2 = CircleCNR(Center=graft_2, Normal=Vector(0, 0, 1), Radius=Slider(0.527, range=0..5))
eval = EvaluateCurve(Curve=reparameterize(circle), Parameter=[Slider(0.544, range=0..1), Slider(0.664, range=0..1)])  # -> Point, Tangent, Angle
ln = Line(StartPoint=graft_2, EndPoint=eval.Point)
trim = TrimWithRegion(Curve=ln, Region=circle_2)  # -> Inside, Outside
crv_2 = Curve(trim.Outside)
number_slider = Slider(108.701, range=1..360)
random_2 = Random(Range="360", Number=panel_2, Seed="2596")
pshift = ShiftPaths(Data=crv_2, Offset="-1")
graft_3 = GraftTree(Tree=random_2, IncludeEmptyLists=True, IncludeNullItems=True)
panel_3 = Panel(random_2)
rotate = Rotate(Geometry=pshift, Angle=degrees(graft_3), Plane=graft_2)  # -> Geometry, Transform
